# Grasshopper definition 00_Create_Room_Draw.gh (Grasshopper 1.0.8)
# plug-ins: Pufferfish, Rhino.Inside for Autodesk Revit, MetaHopper, eleFront5, Wombat

doubleclick = BooleanToggle(False)
dss_annotation_panel = Panel("Help on WhiteWork")
# Segment
# group modules into larger coherent parts
dss_log_v5_2 = PythonScript(Help=doubleclick)  # inputs Help: Boolean
# ---------- dss_log_v5_2: Python ----------
"""
Set grasshopper template and provide easy acces to Help file in intranet

"""

"""
Credits:
    20211117
    Created by Vladimir Ondejcik
    White arkitekter AB

Based on:
    WOMBAT version <0.0.1>
    Script by <Brian Ringley>
        def libraries() by <Giulio Piacentino> see <http://www.grasshopper3d.com/forum/topics/gh-filename-is-python>
        def writeToFile() by <Data Analytics Society> see <https://www.youtube.com/watch?v=-TF3mXhnCDw>
    Script version <15 September 2015> 
    Copyright <Creative Commons Sharealike>
"""


#add dsearch default path located on cad.local
import sys
new_path = r"\\sesthfs02\DSEARCH\REPOSITORY\Grasshopper\Xtras\DsearchCode"
if new_path not in sys.path: sys.path.append(new_path)

#import dsearch plugin
import dsearch as ds

import os

print sys.path

#reload module (this has use when working on module)
#reload(ds.DS_Log)
#reload(ds.DS_Links)

#setup template
template=ds.DS_Links.Template
ds.DS_Log.DS_Template(template)

#run help from module 
if Help:
    helpLink=ds.DS_Links.HelpLink
    ds.DS_Log.DS_Help(helpLink)

    #turn toggle back to false
    obj=ghenv.Component.Params.Input[0].Sources[0]
    obj.Value=False
    obj.ExpireSolution(True)
# ---------- end dss_log_v5_2 ----------

# ----
# DSS_Author: Staffan Linné
# Staffan.Linne@white.se
dss_projectname = Panel("name")
dss_projectnumber = Panel("0000")

# ----
# Organization of Grasshopper scripts at White:
# Script should be created and annotated always with notion that other person will need to use/edit them.
# Build your script in modules and segments, use color coding and annotation according this template.
# This standard should be applied to all scripts, big or small.
# 
# Read  guide on white work:
# "https://work.white.se/grasshopper-developer-guide/"
# For Advanced users:
# For design scripts running more than a month use "dsInitialize" and "dsScriptLog" functions on Dsearch tab to log changes over time.
dss_annotation_panel_2 = Panel("""Tip of a day:
You can change default colour grups by right clicking
Graphical templates are located on "Dsearch" tab""")
# GRAPHIC
# STANDARD
# In
# data and geometry import from rhino or external platforms
image = ImageSampler(dss_annotation_panel_2, Filter="Colour", Interpolate=False, Umax=1, Umin=0, Vmax=1, Vmin=0, Wrap=0)

# ---- group: Header text type
# Texts
query_types = QueryTypes(Kind=3, FamilyName="Text")
value_picker = ValuePicker(query_types)

# ---- group: Select text types- No selection --> No texts / Section Name text type
query_types_2 = QueryTypes(Kind=3, FamilyName="Text")
value_picker_2 = ValuePicker(query_types_2)

# ---- group: Section Label
distance_from_view_to_label = Panel("5")

# ---- group: Header
heigth_above_line = Panel("30")
num = Number(heigth_above_line)

# ---- group: View template section
query_views = QueryViews(IsDependent=False, IsTemplate=True)
value_picker_3 = ValuePicker(query_views, SearchPattern="460")

# ----
# INTRODUCTION
# This is a script ment to create room views from a specific room and place them on a sheet along a line.
# 
# The tracking of the views is based on the view name.
# 
# The script is intended to be used with a set of other scripts creating detail objects on the views and using the same tracking.
query_line_styles = QueryLineStyles()
# 1. Preperations/settings
# Line borders around views
value_picker_4 = ValuePicker(query_line_styles, SearchPattern="RiR")

# ---- group: View template plan
query_views_2 = QueryViews(IsDependent=False, IsTemplate=True)
value_picker_5 = ValuePicker(query_views_2, SearchPattern="460")

# ---- group: Border detail lines plan
onoff = EnableDisableObject(Enabled=Toggle(False), AllObjects_Object=[add_detail_line, curve_line_style])

# ---- group: Border detail lines elev/sections
onoff_2 = EnableDisableObject(Enabled=Toggle(True), AllObjects_Object=[add_detail_line_2, curve_line_style_2])

# ---- group: Select text types- No selection --> No texts
type = Type(value_picker)
type_2 = Type(value_picker_2)

# ----
# View Templates
view = View(value_picker_3)
view_2 = View(value_picker_5)

# ---- group: Section type
# Section input
view_family = ViewFamily({"3D View": 102, "Floor Plan": 109, "Ceiling Plan": 111, "Structural Plan": 120, "Area Plan": 110, "Elevation": 114, "Section": 112, "Detail View": 113, "Drafting View": 108, "Rendering": 104, "Walkthrough": 103, "Legend": 117, "Sheet": 107, "Schedule": 105, "Graphical Column Schedule": 119, "Panel Schedule": 118, "Cost Report": 106, "Loads Report": 115, "Pressure Loss Report": 116, "Systems Analysis Report": 121}, selected="Section")
query_view_types = QueryViewTypes(ViewFamily=view_family)
value_picker_6 = ValuePicker(query_view_types)

# ---- group: Extra distance for plan view
# User Interface: I/O
# Extra gap for plan view
panel = Panel("50")
num_2 = Number(panel)

# ---- group: Distance from wall
panel_2 = Panel("300")

# ----
panel_3 = Panel("""A
B
C
D
E
F
G
H""")
# View naming
panel_4 = Panel(" VY ")

# ----
# Control
# General
# Monitor
# Out
# variable parameters and script execution
# (sliders, boolean togggle, text input,...)
# monitor data and geometry preview (used for panels for example)
# output data to rhino or external platforms
# WIP
# Annotation
# Plugin
# general annotation and notes
# textbased scripting and special plugins
# f.ex: HumanUI, kangaroo,...
# problematic or under repair or construction
dss_annotation_panel_3 = Panel("general development modules")

num_3 = Number(panel_2)

boolean_toggle = BooleanToggle(True)

# ---- group: Choose room
query_rooms = QueryRooms(Placed=True)
value_picker_7 = ValuePicker(query_rooms, SearchPattern="wc")

# ----
# 3. Run script
room = Room(flatten(query_rooms))
element_parameter = ElementParameter(Element=room, Parameter="Name")  # -> Element, Value
element_parameter_2 = ElementParameter(Element=room, Parameter="Number")  # -> Element, Value
concat = Concatenate(FragmentA=element_parameter_2.Value, FragmentB=element_parameter.Value, JoinSeparator=" ")
py3 = Python3Script(Items=concat)  # -> out, SelectedItems; inputs Items: list
# ---------- py3: Python ----------
"""
GhPython: Searchable ListBox selection dialog with Enter/Escape keyboard shortcuts for Rhino.Inside.Revit

Inputs:
  Items (list)            - list of objects to display (display uses str(obj))
  Title (str)             - optional dialog title (default "Select items")
  AllowMulti (bool)       - optional, allow multiple selection (default True)
  PreselectIndices (list) - optional zero-based indices to preselect (default [])
  Width (int)             - optional dialog width (default 420)
  Height (int)            - optional dialog height (default 360)

Outputs:
  SelectedItems (list) - list of selected original items (empty if none or Cancel)
  Result (str)         - "OK" or "Cancel"
"""

import clr
import System

# Add WinForms references
clr.AddReference("System.Windows.Forms")
clr.AddReference("System.Drawing")

from System.Windows.Forms import Form, ListBox, Button, AnchorStyles, DialogResult, Label, FormStartPosition, SelectionMode, TextBox
from System.Drawing import Size, Point

# Input validation and defaults
def validate_input(var_name, default_value, expected_type=None):
    """Safely get input variable with default fallback"""
    try:
        value = globals().get(var_name, default_value)
        if value is None:
            return default_value
        if expected_type and not isinstance(value, expected_type):
            return default_value
        return value
    except:
        return default_value

# Validate all inputs
Items = validate_input('Items', [], list)
Title = validate_input('Title', "Select items", str)
AllowMulti = validate_input('AllowMulti', True, bool)
PreselectIndices = validate_input('PreselectIndices', [], list)
Width = validate_input('Width', 420, int)
Height = validate_input('Height', 360, int)

# Ensure Width and Height are reasonable
Width = max(300, min(1200, Width))
Height = max(220, min(800, Height))

def show_listbox_dialog(items, title="Select items", allow_multi=True, preselect=None, width=420, height=360):
    """
    Show modal dialog with a searchable ListBox. Supports Enter->OK and Escape->Cancel.
    Returns (selected_original_items_list, result_str) where result_str is "OK" or "Cancel".
    """
    preselect = preselect or []
    original_items = list(items) if items is not None else []
    
    # Handle empty items list
    if not original_items:
        return [], "Cancel"
    
    display_strings = [str(it) for it in original_items]

    # Build form
    form = Form()
    form.Text = str(title)
    form.Size = Size(width, height)
    form.StartPosition = FormStartPosition.CenterScreen
    form.MinimizeBox = False
    form.MaximizeBox = False
    form.FormBorderStyle = System.Windows.Forms.FormBorderStyle.FixedDialog
    form.ShowInTaskbar = False
    form.KeyPreview = True  # capture key presses at the form level

    # Label
    label = Label()
    label.Text = "Select items and press Enter to confirm, or Esc to cancel."
    label.AutoSize = False
    label.Size = System.Drawing.Size(width - 40, 20)
    label.Location = Point(10, 10)
    form.Controls.Add(label)

    # Search label
    search_label = Label()
    search_label.Text = "Search:"
    search_label.AutoSize = True
    search_label.Location = Point(10, 35)
    form.Controls.Add(search_label)

    # Search TextBox
    search_box = TextBox()
    search_box.Size = Size(width - 40, 22)
    search_box.Location = Point(10, 55)
    search_box.Anchor = AnchorStyles.Top | AnchorStyles.Left | AnchorStyles.Right
    form.Controls.Add(search_box)

    # ListBox
    lb = ListBox()
    lb.Size = Size(width - 40, height - 160)
    lb.Location = Point(10, 85)
    lb.Anchor = AnchorStyles.Top | AnchorStyles.Bottom | AnchorStyles.Left | AnchorStyles.Right
    # Selection mode
    lb.SelectionMode = SelectionMode.MultiExtended if allow_multi else SelectionMode.One

    # Store mapping between filtered display and original indices
    current_mapping = []

    # Fill listbox with all items initially
    def populate_listbox(filter_text=""):
        lb.Items.Clear()
        current_mapping[:] = []  # Clear the mapping list
        
        for i, ds in enumerate(display_strings):
            if filter_text == "" or filter_text.lower() in ds.lower():
                lb.Items.Add(ds)
                current_mapping.append(i)  # Store original index
    
    # Initial population
    populate_listbox()
    form.Controls.Add(lb)

    # Search functionality - filter listbox in real-time
    def filter_list(sender, args):
        search_text = search_box.Text
        populate_listbox(search_text)
    
    search_box.TextChanged += filter_list

    # Preselect indices if valid (only works when no search filter is applied)
    for idx in preselect:
        try:
            idx_int = int(idx)
            if 0 <= idx_int < lb.Items.Count:
                lb.SetSelected(idx_int, True)
        except:
            pass

    # Buttons
    btn_ok = Button()
    btn_ok.Text = "OK"
    btn_ok.Size = System.Drawing.Size(80, 28)
    btn_ok.Location = Point(width - 200, height - 70)
    btn_ok.Anchor = AnchorStyles.Bottom | AnchorStyles.Right

    def on_ok(sender, args):
        form.DialogResult = DialogResult.OK
        form.Close()
    btn_ok.Click += on_ok
    form.Controls.Add(btn_ok)

    btn_cancel = Button()
    btn_cancel.Text = "Cancel"
    btn_cancel.Size = System.Drawing.Size(80, 28)
    btn_cancel.Location = Point(width - 100, height - 70)
    btn_cancel.Anchor = AnchorStyles.Bottom | AnchorStyles.Right

    def on_cancel(sender, args):
        form.DialogResult = DialogResult.Cancel
        form.Close()
    btn_cancel.Click += on_cancel
    form.Controls.Add(btn_cancel)

    # Keyboard handling: Enter -> OK, Escape -> Cancel
    def on_key_down(sender, args):
        # args is System.Windows.Forms.KeyEventArgs
        try:
            # Don't trigger OK when typing in search box, only allow Escape
            if sender == search_box:
                if args.KeyCode == System.Windows.Forms.Keys.Escape:
                    form.DialogResult = DialogResult.Cancel
                    form.Close()
                return
                
            if args.KeyCode == System.Windows.Forms.Keys.Enter:
                form.DialogResult = DialogResult.OK
                form.Close()
            elif args.KeyCode == System.Windows.Forms.Keys.Escape:
                form.DialogResult = DialogResult.Cancel
                form.Close()
        except Exception:
            # swallow exceptions from unexpected key handling
            pass

    form.KeyDown += on_key_down
    search_box.KeyDown += on_key_down

    # Show modal
    res = form.ShowDialog()

    if res == DialogResult.OK:
        # Map selected indices back to original objects using the mapping
        selected = []
        for i in range(lb.SelectedIndices.Count):
            filtered_idx = lb.SelectedIndices[i]
            try:
                # Get the original index from the mapping
                original_idx = current_mapping[filtered_idx]
                selected.append(original_items[original_idx])
            except:
                # Fallback to display string if mapping fails
                selected.append(lb.Items[filtered_idx])
        return selected, "OK"
    else:
        return [], "Cancel"

# Run dialog and set outputs
try:
    selected_items, result = show_listbox_dialog(Items, Title, AllowMulti, PreselectIndices, Width, Height)
except Exception as ex:
    selected_items, result = [], "Cancel"
    print("Error showing selection dialog:", str(ex))

# Set Grasshopper outputs
SelectedItems = selected_items
Result = result
# ---------- end py3 ----------
mindex = MemberIndex(Set=concat, Member=py3.SelectedItems)  # -> Index, Count
item = ListItem(List=room, Index=mindex.Index, Wrap=True)
room_2 = Room(item)

# ---- group: Placerar vyer på sheet
button = Button()
onoff_3 = EnableDisableObject(Enabled=boolean_toggle, AllObjects_Object=[query_views_3, query_views_4, add_viewport])

# ---- group: Skapa vyer
button_2 = Button()
onoff_4 = EnableDisableObject(Enabled=boolean_toggle, AllObjects_Object=[add_floor_plan, add_section_view, view, view_2])

# ---- group: Delete existing views (will not only delete viewport but views also)
button_3 = Button()  # disabled
onoff_5 = EnableDisableObject(Enabled=button_3, AllObjects_Object=[query_views_3, query_views_4, delete_element])  # disabled

# ---- group: Set a line to place rooms along
# 2. Choose placement line
#  and Room
# Set a line to place rooms drawings along here!
active_selection = GraphicalElement()
line = Line(active_selection)
null_item = NullItem(Item=line)  # -> NullFlags, InvalidFlags, Description
cull_pattern = CullPattern(List=active_selection, CullPattern=invert(null_item.NullFlags))
list_item = ListItem(List=cull_pattern, Index=0, Wrap=True)

# ---- group: Text to place under viewport / List of names
txt = Text(panel_3)

# ----
room_3 = Room(room_2)

# ---- group: Header Text
room_4 = Room(room_3)
element_parameter_3 = ElementParameter(Element=room_4, Parameter="Name")  # -> Element, Value

room_5 = Room(room_3)
element_parameter_4 = ElementParameter(Element=room_5, Parameter="Number")  # -> Element, Value
concat_2 = Concatenate(FragmentA=element_parameter_3.Value, FragmentB=element_parameter_4.Value, JoinSeparator=":")
txt_2 = Text(concat_2)

# ---- group: Naming plan view
room_6 = Room(room_3)
element_name = ElementName(Element=room_6)  # -> Element, Name
element_parameter_5 = ElementParameter(Element=room_6, Parameter="Name")  # -> Element, Value
rep = ReplaceText(Text=element_name.Name, Find=":", Replace="-", RecursiveReplace=False)
# Calculating movement of views from model space to paper space (Line on Sheet)
concat_3 = Concatenate(FragmentA=rep, FragmentC=element_parameter_5.Value, JoinSeparator=" ")

# ---- group: Room name
txt_3 = Text(concat_3)

# ---- group: List of letters/numbers
txt_4 = Text(panel_3)

# ---- group: Room name
# Back-end
# Naming of views
txt_5 = Text(concat_3)

# ---- group: View type
txt_6 = Text(panel_4)

# ---- group: Naming sections
concat_4 = Concatenate(FragmentA=txt_5, FragmentC=txt_6, FragmentB=txt_4)

# ---- group: Create view / Undertakshöjd
room_7 = Room(room_3)
spatial_element_boundary = SpatialElementBoundary(SpatialElement=room_7, BoundaryLocation=1)
bbox = BoundingBox(Content=room_7, Plane=PlaneXY(0, 0, 0))  # -> Box, Box_2
debox = DeconstructBox(Box=bbox.Box)  # -> Plane, X, Y, Z
dedomain = DeconstructDomain(Domain=debox.Z)  # -> Start, End
subtraction = Subtraction(A=dedomain.End, B=dedomain.Start)
Z = UnitZ(Factor=subtraction)
extr = Extrude(Base=spatial_element_boundary, Direction=Z)
cap = CapHoles(Brep=extr)
box = Box(cap)
query_categories = QueryCategories(Type=1, Name="Ceilings", IsVisibleUI=True, IsSubcategory=False)
bboxfltr = BoundingBoxFilter(BoundingBox=box, Union=True, Strict=True, Tolerance=0, Inverted=False)  # -> Filter, Target
catfltr = CategoryFilter(Categories=query_categories, Inverted=False)
andfltr = LogicalAndFilter(FilterA=bboxfltr.Filter, FilterB=catfltr)
query_elements = QueryElements(Filter=andfltr, Limit=100)  # -> Elements, Count

# ---- group: Vectors to move the viewports so that they align with the line (not the most beutifull solution...) / Line on sheet
graphical_element = GraphicalElement(list_item)
line_2 = Line(graphical_element)

# ---- group: Vectors to move the viewports so that they align with the line (not the most beutifull solution...) / Vertical or horisontal line on sheet
Y = UnitY(Factor=1)
dprod = DotProduct(VectorA=line_2, VectorB=Y, Unitize=False)
round = Round(Number=dprod)  # -> Nearest, Floor, Ceiling
bool = Boolean(round.Nearest)
filter = StreamFilter(Gate=bool, Stream0="0", Stream1="2")

# ---- group: Adjoustment to line on sheet to get placement at the ends right / Line on sheet
graphical_element_2 = GraphicalElement(list_item)
line_3 = Line(graphical_element_2)

# ---- group: Create view / Undertakshöjd / If there is a ceiling -> ceiling height else room heigth
lng = ListLength(List=query_elements.Elements)
element_parameter_6 = ElementParameter(Element=query_elements.Elements, Parameter="Height Offset From Level")  # -> Element, Value
bool_2 = Boolean(lng)
filter_2 = StreamFilter(Gate=bool_2, Stream0=subtraction, Stream1=element_parameter_6.Value)
Z_2 = UnitZ(Factor=filter_2)

# ---- group: Create view / Section view boxes / Distance from walls
num_4 = Number(num_3)

# ---- group: Sheet that line is placed on
graphical_element_3 = GraphicalElement(graphical_element_2)
query_sheets = QuerySheets(Placeholder=False, AppearsInSheetList=True, Assembly=null)
element_workset = ElementWorkset(Element=graphical_element_3)  # -> Element, Workset, Status
element_workset_2 = ElementWorkset(Element=query_sheets)  # -> Element, Workset, Status
workset_identity = WorksetIdentity(Workset=element_workset.Workset)
workset_identity_2 = WorksetIdentity(Workset=element_workset_2.Workset)
replace = ReplaceMembers(Set=workset_identity, Find=workset_identity_2, Replace=query_sheets)
sheet = Sheet(replace)

# ---- group: Create views and borders
room_8 = Room(room_3)
level = Level(room_8)

# ---- group: Add viewports / Text ovanför rumsritningar / Line on sheet
graphical_element_4 = GraphicalElement(list_item)
line_4 = Line(graphical_element_4)

# ---- group: Text to place under viewport
txt_7 = Text(panel_4)
concat_5 = Concatenate(FragmentC=txt_7, FragmentB=txt)

# ----
tsort = SortText(Keys=txt_3, Culture=127)  # -> Keys, Values

query_views_3 = QueryViews(ViewName=tsort.Keys, IsDependent=False, IsTemplate=False)  # -> simplify(Views)

view_crop_region = ViewCropRegion(View=query_views_3)  # -> View, CropView, CropRegionVisible, CropRegion
element_parameter_7 = ElementParameter(Element=view_crop_region.View, Parameter="View Scale")  # -> Element, Value

# ---- group: Adjoustment to line on sheet to get placement at the ends right / View scale
num_5 = Number(element_parameter_7.Value)

# ---- group: Vectors to move the viewports so that they align with the line (not the most beutifull solution...) / The movement needed to move the edge of the section view to the center point / View scale
num_6 = Number(element_parameter_7.Value)

# ---- group: Vectors to move the viewports so that they align with the line (not the most beutifull solution...) / The movement needed to move the edge of the section view to the center point
box_2 = Box(view_crop_region.CropRegion)
rec = Rectangle(box_2)
pcen = PolygonCenter(Polyline=rec)  # -> CenterV, CenterE, CenterA
simplify = SimplifyCurve(Curve=rec)  # -> Curve, Simplified
explode = Explode(Curve=simplify.Curve, Recursive=True)  # -> simplify(Segments), simplify(Vertices)
pt = Point(pcen.CenterV)
pt_2 = Point(explode.Vertices)
cset = CreateSet(List=pt_2)  # -> Set, Map
item_2 = ListItem(List=cset.Set, Index=filter, Wrap=True)  # -> flatten(Item)
vec2pt = Vector2Pt(PointA=pt, PointB=item_2, Unitize=False)  # -> Vector, Length
division = Division(A=vec2pt.Vector, B=num_6)

# ---- group: Vectors to move the viewports so that they align with the line (not the most beutifull solution...) / The movement needed to move the edge of the section view to the center point / View scale
num_7 = Number(element_parameter_7.Value)

# ---- group: Create view / Order of elevation lines - this is done to be able to start with first elevation upwards
room_9 = Room(room_3)
panel_5 = Panel("-1")

spatial_element_boundary_2 = SpatialElementBoundary(SpatialElement=room_9, BoundaryLocation=0)
simplify_2 = SimplifyCurve(Curve=spatial_element_boundary_2)  # -> Curve, Simplified
close = CloseCurve(Curve=simplify_2.Curve, Tolerance=0)
crv = Curve(close)

simplify_3 = SimplifyCurve(Curve=crv)  # -> Curve, Simplified
explode_2 = Explode(Curve=simplify_3.Curve, Recursive=True)  # -> Segments, Vertices
crv_2 = Curve(close)

# ---- group: Create view / Order of elevation lines - this is done to be able to start with first elevation upwards / Sorting on X and Y coordinates
end = EndPoints(Curve=explode_2.Segments)  # -> Start, End
pdecon = Deconstruct(Point=end.End)  # -> XComponent, YComponent, ZComponent
sort = SortList(Keys=pdecon.XComponent, ValuesA=end.End)  # -> Keys, ValuesA
sort_2 = SortList(Keys=pdecon.XComponent, ValuesA=pdecon.YComponent)  # -> Keys, ValuesA
cset_2 = CreateSet(List=sort.Keys)  # -> Set, Map
tree = CreateTree(Data=sort.ValuesA, Path=cset_2.Map)
tree_2 = CreateTree(Data=sort_2.ValuesA, Path=cset_2.Map)
sort_3 = SortList(Keys=tree_2, ValuesA=tree)  # -> Keys, flatten(ValuesA)

# ---- group: Adjoustment to line on sheet to get placement at the ends right
bool_3 = Boolean(round.Nearest)
line_5 = Line(explode.Segments)
num_8 = Number(num_2)
neg = Negative(Value=num_8)

# ---- group: Adjoustment to line on sheet to get placement at the ends right / Höjden på planvyn...
Y_2 = UnitY(Factor=1)
dprod_2 = DotProduct(VectorA=line_5, VectorB=Y_2, Unitize=False)
bool_4 = Boolean(dprod_2)
cull = CullPattern(List=line_5, CullPattern=bool_4)
item_3 = ListItem(List=cull, Index=0, Wrap=True)
len = Length(Curve=item_3)
division_2 = Division(A=len, B=num_5)
neg_2 = Negative(Value=division_2)
panel_6 = Panel("0")
ext = ExtendCurve(Curve=line_3, Type=0, Start=neg_2, End=panel_6)  # -> flatten(Curve)

# ---- group: Adjoustment to line on sheet to get placement at the ends right / Bredden? på planvyn...
X = UnitX(Factor=1)
dprod_3 = DotProduct(VectorA=line_5, VectorB=X, Unitize=False)
bool_5 = Boolean(dprod_3)
cull_2 = CullPattern(List=line_5, CullPattern=bool_5)
item_4 = ListItem(List=cull_2, Index=0, Wrap=True)
len_2 = Length(Curve=item_4)
division_3 = Division(A=len_2, B=num_5)
neg_3 = Negative(Value=division_3)
ext_2 = ExtendCurve(Curve=line_3, Type=0, Start=neg_3, End="0")  # -> flatten(Curve)

# ---- group: Adjoustment to line on sheet to get placement at the ends right (continued)
ext_3 = ExtendCurve(Curve=line_3, Type=0, Start=neg, End=panel_6)  # -> flatten(Curve)
filter_3 = StreamFilter(Gate=bool_3, Stream0=ext_2, Stream1=ext)

# ---- group: Vectors to move the viewports so that they align with the line (not the most beutifull solution...) / The movement needed to move the edge of the section view to the center point
number_slider = Slider(1, range=0..1)
bool_6 = Boolean(bool)

# ---- group: Create view / Order of elevation lines - this is done to be able to start with first elevation upwards (continued)
item_5 = ListItem(List=flatten(sort_3.ValuesA), Index=0, Wrap=True)
crv_cp = CurveClosestPoint(Point=item_5, Curve=crv)  # -> Point, Parameter, Distance
seam = Seam(Curve=crv, Seam=crv_cp.Parameter)
simplify_4 = SimplifyCurve(Curve=seam)  # -> Curve, Simplified
explode_3 = Explode(Curve=simplify_4.Curve, Recursive=True)  # -> Segments, Vertices

# ---- group: Create view / Order of elevation lines - this is done to be able to start with first elevation upwards / If one would like to have the first elevation in other direction- try to insert number to this component
shift = ShiftList(List=explode_3.Segments, Shift=panel_5, Wrap=True)

# ---- group: Create view / Order of elevation lines - this is done to be able to start with first elevation upwards (continued)
line_6 = Line(shift)

# ---- group: Create view / Section view boxes
line_7 = Line(line_6)
vec = Vector(Z_2)
vec_2 = Vector(line_7)
Z_3 = UnitZ(Factor=1)
neg_4 = Negative(Value=vec_2)
xprod = CrossProduct(VectorA=neg_4, VectorB=Z_3, Unitize=False)  # -> unitize(Vector), Length
multiplication = Multiplication(A=xprod.Vector, B=num_4)
line_8 = Line(line_7)
move = Move(Geometry=line_8, Motion=multiplication)  # -> Geometry, Transform
extr_2 = Extrude(Base=move.Geometry, Direction=vec)

# ---- group: Create view
edges = BrepEdges(Brep=extr_2)  # -> simplify(Naked), Interior, NonManifold
num_9 = Number(num_3)
join = JoinCurves(Curves=edges.Naked, Preserve=False)  # -> flatten(Curves)
rec_2 = Rectangle(join)
boxrec = BoxRectangle(Rectangle=rec_2, Height=num_9)

# ---- group: Create view / Shortening of list of view names
lng_2 = ListLength(List=extr_2)
txt_8 = Text(concat_4)
series = Series(Start=0, Step=1, Count=lng_2)
item_6 = ListItem(List=txt_8, Index=series, Wrap=True)  # -> reverse(Item)

# ---- group: List index
int = Integer(series)

# ---- group: Create view
# Creation of boxes to define Section views and curves to define crops of views
txt_9 = Text(item_6)

# ---- group: Section names
txt_10 = Text(txt_9)

# ---- group: Text to place under viewport (continued)
item_7 = ListItem(List=concat_5, Index=int, Wrap=True)  # -> reverse(Item)
txt_11 = Text(item_7)
tsort_2 = SortText(Keys=txt_10, Values=txt_11, Culture=127)  # -> Keys, Values

# ----
query_views_4 = QueryViews(ViewName=tsort_2.Keys, IsDependent=False, IsTemplate=False)  # -> simplify(flatten(Views))
view_crop_region_2 = ViewCropRegion(View=query_views_4)  # -> View, CropView, CropRegionVisible, CropRegion
ins = InsertItems(List=query_views_4, Item=query_views_3, Indices=Slider(0, range=0..100), Wrap=True)
rec_3 = Rectangle(view_crop_region_2.CropRegion)
view_3 = View(ins)

delete_element = DeleteElement(Elements=[query_views_3, query_views_4])  # disabled

# ---- group: Create views and borders
# Adding views
txt_12 = Text(concat_3)
viewtype = ViewType(value_picker_6)
txt_13 = Text(txt_9)
box_3 = Box(boxrec)

# ---- group: Create views and borders / Create plan view
view_4 = View(view_2)
add_floor_plan = AddFloorPlan(Level=level, Name=txt_12, FailureProcessingMode=2)
crv_3 = Curve(crv_2)
view_crop_region_3 = ViewCropRegion(View=add_floor_plan, CropView=True, CropRegion=crv_3)  # -> View, CropView, CropRegionVisible, CropRegion
element_parameter_8 = ElementParameter(Element=add_floor_plan, Parameter="View Template", Value=view_4)  # -> Element, Value

# ---- group: Create views and borders / Create views
add_section_view = AddSectionView(Frame=box_3, Name=txt_13, Type=viewtype, FailureProcessingMode=2)

# ---- group: Create views and borders / Add line borders
crv_4 = Curve(add_section_view)
view_5 = View(add_section_view)
view_6 = View(add_floor_plan)
crv_5 = Curve(explode_2.Segments)
line_style = LineStyle(value_picker_4)
explode_4 = Explode(Curve=crv_4, Recursive=True)  # -> simplify(Segments), Vertices
add_detail_line = AddDetailLine(View=view_6, Curve=crv_5)  # disabled
add_detail_line_2 = AddDetailLine(View=simplify(graft(view_5)), Curve=explode_4.Segments)
curve_line_style = CurveLineStyle(Element=add_detail_line, LineStyle=line_style)  # -> Element, LineStyle; disabled
curve_line_style_2 = CurveLineStyle(Element=add_detail_line_2, LineStyle=line_style)  # -> Element, LineStyle

# ---- group: Create views and borders
view_7 = View(view)
element_parameter_9 = ElementParameter(Element=add_section_view, Parameter="Far Clip Offset", Value=Slider(600, range=0..1000))  # -> Element, Value
element_parameter_10 = ElementParameter(Element=add_section_view, Parameter="View Template", Value=view_7)  # -> Element, Value

# ---- group: Vectors to move the viewports so that they align with the line (not the most beutifull solution...) / The movement needed to move the edge of the section view to the center point (continued)
rec_4 = Rectangle(rec_3)
explode_5 = Explode(Curve=rec_4, Recursive=True)  # -> simplify(Segments), Vertices
line_9 = Line(explode_5.Segments)
item_8 = ListItem(List=line_9, Index="3", Wrap=True)
item_9 = ListItem(List=line_9, Index=0, Wrap=True)
len_3 = Length(Curve=item_8)
len_4 = Length(Curve=item_9)
division_4 = Division(A=len_4, B="2")
division_5 = Division(A=len_3, B="2")
vec_3 = VectorXYZ(XComponent=division_5, YComponent=division_4, ZComponent=0)  # -> Vector, Length

# ---- group: Vectors to move the viewports so that they align with the line (not the most beutifull solution...) / The movement needed to move the edge of the section view to the center point / Kräver att detail line ram skapas
vec_4 = Vector(flatten(vec_3.Vector))

# ---- group: Vectors to move the viewports so that they align with the line (not the most beutifull solution...) / The movement needed to move the edge of the section view to the center point (continued)
neg_5 = Negative(Value=vec_4)
filter_4 = StreamFilter(Gate=bool_6, Stream0=neg_5, Stream1=vec_4)
vec_5 = Vector(filter_4)
division_6 = Division(A=vec_5, B=num_7)

# ---- group: Matchar position med linje
line_10 = Line(filter_3)
view_8 = View(view_3)
lng_3 = ListLength(List=view_8)
vec_6 = Vector(division_6)
vec_7 = Vector(division)
line_11 = Line(ext_3)
subtraction_2 = Subtraction(A=lng_3, B="1")
divide = DivideCurve(Curve=line_11, Count=subtraction_2, Kinks=False)  # -> Points, Tangents, Parameters
end_2 = EndPoints(Curve=line_10)  # -> Start, End
number_slider_2 = Slider(0, range=0..100)

# ---- group: Insert point for plan view
replace_2 = ReplaceItems(List=divide.Points, Item=end_2.Start, Indices="0", Wrap=False)

# ---- group: Insert vector for plan view
ins_2 = InsertItems(List=vec_6, Item=vec_7, Indices=number_slider_2, Wrap=True)

# ---- group: Matchar position med linje (continued)
addition = Addition(A=ins_2, B=replace_2)

# ---- group: Add viewports
# Adding viewports
sheet_2 = Sheet(sheet)
pt_3 = Point(addition)
view_9 = View(view_3)
add_viewport = AddViewport(Sheet=sheet_2, View=view_9, Point=pt_3)
no_view_title = Panel("215329")
query_element = QueryElement(Id=no_view_title)
element_type = ElementType(Element=add_viewport, Type=query_element)  # -> Element, Type
rec_5 = Rectangle(add_viewport)
sheet_3 = Sheet(add_viewport)

# ---- group: Add viewports / Text under vyer
rec_6 = Rectangle(rec_5)
crv_6 = Curve(graphical_element_2)
simplify_5 = SimplifyCurve(Curve=rec_6)  # -> Curve, Simplified
explode_6 = Explode(Curve=simplify_5.Curve, Recursive=True)  # -> simplify(Segments), simplify(Vertices)
pt_4 = Point(explode_6.Vertices)
cset_3 = CreateSet(List=pt_4)  # -> Set, Map
item_10 = ListItem(List=cset_3.Set, Index="0", Wrap=True)  # -> flatten(Item)
crv_cp_2 = CurveClosestPoint(Point=item_10, Curve=crv_6)  # -> Point, Parameter, Distance

sheet_4 = Sheet(sheet_3)
num_10 = Number(distance_from_view_to_label)
type_3 = Type(type_2)
txt_14 = Text(tsort_2.Values)
ins_3 = InsertItems(List=txt_14, Item="Plan", Indices="0", Wrap=True)  # -> simplify(List)
trim = TextTrim(Text=ins_3, Start=True, End=True)
rumsinfo = Panel(trim)
pt_5 = Point(crv_cp_2.Point)
Y_3 = UnitY(Factor=num_10)
item_11 = ListItem(List=sheet_4, Index=0, Wrap=True)
move_2 = Move(Geometry=pt_5, Motion=Y_3)  # -> Geometry, Transform
add_text = AddText(View=item_11, Point=move_2.Geometry, Content=rumsinfo, Type=type_3)
rec_7 = Rectangle(add_text)
brec = BoundingRectangle(Geometry=simplify(graft(rec_7)), Plane=PlaneXY(0, 0, 0), Axis=0, Slide=0, Union=True)  # -> Bounding, DimensionX, DimensionY
element_location = ElementLocation(Element=add_text)  # -> Element, Location, Hand, Facing, WorkPlane
division_7 = Division(A=brec.DimensionX, B="2")
X_2 = UnitX(Factor=division_7)  # -> flatten(UnitVector)
move_3 = Move(Geometry=element_location.Location, Motion=X_2)  # -> Geometry, Transform
element_location_2 = ElementLocation(Element=add_text, Location=move_3.Geometry)  # -> Element, Location, Hand, Facing, WorkPlane

# ---- group: Add viewports / Text ovanför rumsritningar
type_4 = Type(type)
# Creating texts on sheet
sheet_5 = Sheet(sheet_3)
num_11 = Number(num)
txt_15 = Text(txt_2)
rumsinfo_2 = Panel(txt_15)
end_3 = EndPoints(Curve=line_4)  # -> Start, End
Y_4 = UnitY(Factor=num_11)
item_12 = ListItem(List=sheet_5, Index=0, Wrap=True)
move_4 = Move(Geometry=end_3.Start, Motion=Y_4)  # -> Geometry, Transform
add_text_2 = AddText(View=item_12, Point=move_4.Geometry, Content=rumsinfo_2, Type=type_4)
rec_8 = Rectangle(add_text_2)
element_parameter_11 = ElementParameter(Element=add_text_2, Parameter="Vertical Align", Value="512")  # -> Element, Value
element_parameter_12 = ElementParameter(Element=add_text_2, Parameter="Horizontal Align", Value="64")  # -> Element, Value
brec_2 = BoundingRectangle(Geometry=rec_8, Plane=PlaneXY(0, 0, 0), Axis=0, Slide=0, Union=True)  # -> Bounding, DimensionX, DimensionY
element_location_3 = ElementLocation(Element=add_text_2)  # -> Element, Location, Hand, Facing, WorkPlane
division_8 = Division(A=brec_2.DimensionX, B="2")
X_3 = UnitX(Factor=division_8)
move_5 = Move(Geometry=element_location_3.Location, Motion=X_3)  # -> Geometry, Transform
element_location_4 = ElementLocation(Element=add_text_2, Location=move_5.Geometry)  # -> Element, Location, Hand, Facing, WorkPlane

# ---- group: Add viewports
element_parameter_13 = ElementParameter(Element=add_text, Parameter="Vertical Align", Value="512")  # -> Element, Value
element_parameter_14 = ElementParameter(Element=add_text, Parameter="Horizontal Align", Value="64")  # -> Element, Value
