# Grasshopper definition 01_Room_WallFinish.gh (Grasshopper 1.0.8)
# plug-ins: Pufferfish, Rhino.Inside for Autodesk Revit, MetaHopper, eleFront

query_levels = QueryLevels(BuildingStory=True)
value_picker = ValuePicker(query_levels)

doubleclick = BooleanToggle(False)
dss_annotation_panel = Panel("Help on WhiteWork")
# Segment
# group modules into larger coherent parts
# User Interface: I/O
dss_log_v5_2 = PythonScript(Help=doubleclick)  # inputs Help: Boolean
# ---------- dss_log_v5_2: Python ----------
"""
Set grasshopper template and provide easy acces to Help file in intranet

"""

"""
Credits:
    20211117
    Created by Vladimir Ondejcik
    White arkitekter AB

Based on:
    WOMBAT version <0.0.1>
    Script by <Brian Ringley>
        def libraries() by <Giulio Piacentino> see <http://www.grasshopper3d.com/forum/topics/gh-filename-is-python>
        def writeToFile() by <Data Analytics Society> see <https://www.youtube.com/watch?v=-TF3mXhnCDw>
    Script version <15 September 2015> 
    Copyright <Creative Commons Sharealike>
"""


#add dsearch default path located on cad.local
import sys
new_path = r"\\sesthfs02\DSEARCH\REPOSITORY\Grasshopper\Xtras\DsearchCode"
if new_path not in sys.path: sys.path.append(new_path)

#import dsearch plugin
import dsearch as ds

import os

print sys.path

#reload module (this has use when working on module)
#reload(ds.DS_Log)
#reload(ds.DS_Links)

#setup template
template=ds.DS_Links.Template
ds.DS_Log.DS_Template(template)

#run help from module 
if Help:
    helpLink=ds.DS_Links.HelpLink
    ds.DS_Log.DS_Help(helpLink)

    #turn toggle back to false
    obj=ghenv.Component.Params.Input[0].Sources[0]
    obj.Value=False
    obj.ExpireSolution(True)
# ---------- end dss_log_v5_2 ----------

dss_projectnumber = Panel("0000")
dss_projectname = Panel("name")

# ----
# Organization of Grasshopper scripts at White:
# Script should be created and annotated always with notion that other person will need to use/edit them.
# Build your script in modules and segments, use color coding and annotation according this template.
# This standard should be applied to all scripts, big or small.
# 
# Read  guide on white work:
# "https://work.white.se/grasshopper-developer-guide/"
# For Advanced users:
# For design scripts running more than a month use "dsInitialize" and "dsScriptLog" functions on Dsearch tab to log changes over time.
dss_annotation_panel_2 = Panel("""Tip of a day:
You can change default colour grups by right clicking
Graphical templates are located on "Dsearch" tab""")
# GRAPHIC
# STANDARD
# In
# data and geometry import from rhino or external platforms
image = ImageSampler(dss_annotation_panel_2, Filter="Colour", Interpolate=False, Umax=1, Umin=0, Vmax=1, Vmin=0, Wrap=0)

query_rooms = QueryRooms(Placed=True, Level=value_picker)
value_picker_2 = ValuePicker(query_rooms, SearchPattern="1037")
list_length = ListLength(List=value_picker_2)
stream_filter = StreamFilter(Gate=Toggle(True), Stream0=query_rooms, Stream1=value_picker_2)
boolean = Boolean(list_length)

active_selection = GraphicalElement()
query_categories = QueryCategories(Type=1, Name="Walls", IsVisibleUI=True, IsSubcategory=False)
query_categories_2 = QueryCategories(Type=1, Name="Rooms", IsVisibleUI=True, IsSubcategory=False)
category_filter = CategoryFilter(Categories=query_categories, Inverted=False)
category_filter_2 = CategoryFilter(Categories=query_categories_2, Inverted=False)
filter_elements = FilterElements(Elements=active_selection, Filter=category_filter_2)
filter_elements_2 = FilterElements(Elements=active_selection, Filter=category_filter)
cull_pattern = CullPattern(List=active_selection, CullPattern=filter_elements)
cull_pattern_2 = CullPattern(List=active_selection, CullPattern=filter_elements_2)
room = Room(cull_pattern)
wall = Wall(cull_pattern_2)

button = Button()  # disabled

höjd_ytskikt = Panel("2600")
tjocklek = Panel("20")
sockel_höjd = Panel("200")

panel = Panel("Wall_Material_Asset_RiR")
enable_disable_object = EnableDisableObject(Enabled=button)  # disabled

höjd_över_golvet = Slider(0, range=0..1000)
höjd = Slider(1800, range=0..10000)

# ----
# Control
# General
# Monitor
# Out
# variable parameters and script execution
# (sliders, boolean togggle, text input,...)
# monitor data and geometry preview (used for panels for example)
# output data to rhino or external platforms
# WIP
# Annotation
# Plugin
# general annotation and notes
# textbased scripting and special plugins
# f.ex: HumanUI, kangaroo,...
# problematic or under repair or construction
dss_annotation_panel_3 = Panel("general development modules")

list_length_2 = ListLength(List=wall)
list_length_3 = ListLength(List=room)
addition = Addition(A=list_length_2, B=Slider(0, range=0..100))
boolean_2 = Boolean(addition)
md_slider = MDSlider(SliderMode=0, slider_value=Point(0.5, 0.5, 0.5), x_domain=Domain(0, 1), y_domain=Domain(0, 1), z_domain=Domain(0, 1))
plane_normal = PlaneNormal(Origin=Point(0, 0, 0), ZAxis=Vector(0, 0, 1))
unit_z = UnitZ(Factor=1)

# ---- group: Sort surfaces into tree, one branch for each room
boundary_surfaces = BoundarySurfaces()  # -> simplify(Surfaces)
cap_holes = CapHoles()
multiplication = Multiplication(B="40")
extrude = Extrude(Base=boundary_surfaces, Direction=multiplication)
clean_tree = CleanTree(RemoveNulls=True, RemoveInvalid=True, RemoveEmpty=False, Tree=extrude)

# ----
power_of_10 = PowerOf10(Value="5")
solid_intersection = SolidIntersection(BrepsA=clean_tree, BrepsB=flatten(cap_holes))
brep = Brep(simplify(solid_intersection))
brep_2 = Brep()
wall_location_line = WallLocationLine({"Wall Centerline": 0, "Core Centerline": 1, "Finish (Exterior Face)": 2, "Finish (Interior Face)": 3, "Core (Exterior Face)": 4, "Core (Interior Face)": 5}, selected="Finish (Interior Face)")
built_in_parameters = BuiltInParameters("autodesk.revit.parameter:wallAttrRoomBounding-1.0.0", SearchPattern="Room Bounf")
md_slider_2 = MDSlider(SliderMode=0, slider_value=Point(0.5, 0.5, 0.5), x_domain=Domain(0, 1), y_domain=Domain(0, 1), z_domain=Domain(0, 1))
plane = Plane()
panel_2 = Panel("Floor Finish")
panel_3 = Panel("Name")

query_categories_3 = QueryCategories(Type=1, Name="Walls", IsVisibleUI=True, IsSubcategory=False)
query_categories_4 = QueryCategories(Type=1, Name="Rooms", IsVisibleUI=True, IsSubcategory=False)
active_selection_2 = GraphicalElement(stream_filter)
category_filter_3 = CategoryFilter(Categories=query_categories_4, Inverted=False)
category_filter_4 = CategoryFilter(Categories=query_categories_3, Inverted=False)
filter_elements_3 = FilterElements(Elements=active_selection_2, Filter=category_filter_3)
cull_pattern_3 = CullPattern(List=active_selection_2, CullPattern=filter_elements_3)
room_2 = Room(cull_pattern_3)

stream_filter_2 = StreamFilter(Gate=Toggle(False), Stream0=room, Stream1=room_2)
room_3 = Room(stream_filter_2)
brep_3 = Brep(room_3)
bounding_box_filter = BoundingBoxFilter(BoundingBox=simplify(graft(brep_3)), Union=False, Strict=False, Tolerance="5", Inverted=False)  # -> Filter, Target
logical_and_filter = LogicalAndFilter(FilterA=bounding_box_filter.Filter, FilterB=category_filter_4)
query_elements = QueryElements(Filter=logical_and_filter)  # -> Elements, Count

wall_2 = Wall(simplify(query_elements.Elements))

null_item = NullItem(Item=wall_2)  # -> NullFlags, InvalidFlags, Description
cull_pattern_4 = CullPattern(List=wall_2, CullPattern=invert(null_item.NullFlags))
wall_3 = Wall(simplify(cull_pattern_4))
stream_filter_3 = StreamFilter(Gate=boolean_2, Stream0=wall_3, Stream1=wall)

# ---- group: Wall 2D geometry
wall_4 = Wall(stream_filter_3)
unit_z_2 = UnitZ(Factor=1)
line = Line(wall_4)
vector = Vector(line)
cross_product = CrossProduct(VectorA=vector, VectorB=unit_z_2, Unitize=False)  # -> unitize(simplify(Vector)), Length
curve_middle = CurveMiddle(Curve=line)
construct_plane = ConstructPlane(Origin=curve_middle, XAxis=vector, YAxis=cross_product.Vector)
bounding_rectangle = BoundingRectangle(Geometry=simplify(graft(wall_4)), Plane=simplify(graft(construct_plane)), Axis=0, Slide=0, Union=False)  # -> Bounding, DimensionX, DimensionY
project = Project(Geometry=bounding_rectangle.Bounding, Plane=simplify(graft(construct_plane)))  # -> Geometry, Transform

# ----
curve = Curve(reparameterize(simplify(project.Geometry)))

# ---- group: Sort surfaces into tree, one branch for each room
room_4 = Room(stream_filter_2)
brep_4 = Brep(room_4)

room_5 = Room(stream_filter_2)
brep_5 = Brep(room_5)

clash = Clash(FirstSet=brep_5, SecondSet=brep, Distance=0, ResultLimit=100)  # -> ClashCount, ClashPoints, ClashRadii, flatten(FirstIndex), SecondIndex
create_tree = CreateTree(Data=brep, Path=clash.FirstIndex)

room_6 = Room(simplify(graft(stream_filter_2)))
brep_6 = Brep(room_6)

# ----
query_categories_5 = QueryCategories(Type=1, Name="Walls", IsVisibleUI=True, IsSubcategory=False)
query_materials = QueryMaterials()
value_picker_3 = ValuePicker(query_materials)
query_types = QueryTypes(Kind=3, Category=query_categories_5)
default_type = DefaultType(Category=query_categories_5)
value_picker_4 = ValuePicker(query_types)

list_item = ListItem(List=value_picker_3, Index=0, Wrap=True)
add_material = AddMaterial(Name="Wall_Material_RiR", Template=list_item, FailureProcessingMode=1)
extract_material_s_assets = ExtractMaterialsAssets(Material=add_material)  # -> AppearanceAsset, PhysicalAsset, ThermalAsset
material_graphics = MaterialGraphics(Material=add_material, Color=ColourSwatch(SwatchColor=RGBA(5, 138, 138, 170)))  # -> Material, UseRenderAppearance, Color, Transparency, SurfacePatternsForegroundPattern, SurfacePatternsForegroundColor, CutPatternsForegroundPattern, CutPatternsForegroundColor
match_text = MatchText(Text=query_types, RegEx="Basic Wall", Case=True)
cull_pattern_5 = CullPattern(List=query_types, CullPattern=match_text)
list_item_2 = ListItem(List=cull_pattern_5, Index=0, Wrap=True)

construct_compound_structure_layer = ConstructCompoundStructureLayer(Function=4, Material=add_material, Thickness="50")
duplicate_type = DuplicateType(TypeName="Finish_Temp_RiR", Type=list_item_2, FailureProcessingMode=1)

construct_compound_structure = ConstructCompoundStructure(CoreLayers=construct_compound_structure_layer)
host_type_compound_structure = HostTypeCompoundStructure(Type=duplicate_type, Structure=construct_compound_structure)  # -> Type, Structure

# ---- group: Wall boundary that interferes with wall lines
room_7 = Room(room)
spatial_element_boundary = SpatialElementBoundary(SpatialElement=room_7, BoundaryLocation=0)  # -> simplify(Boundary)

# ----
plane_2 = Plane(room_7)
project_2 = Project(Geometry=spatial_element_boundary, Plane=plane_2)  # -> Geometry, Transform
list_length_4 = ListLength(List=room_7)
subtraction = Subtraction(A=list_length_4, B="1")
boolean_3 = Boolean(subtraction)

# ---- group: Wall boundary that interferes with wall lines (continued)
explode = Explode(Curve=project_2.Geometry, Recursive=True)  # -> simplify(Segments), Vertices
extend_curve = ExtendCurve(Curve=explode.Segments, Type=0, Start="-4", End="-4")  # -> simplify(Curve)
curve_curve = CurveCurve(CurveA=simplify(flatten(extend_curve)), CurveB=simplify(curve))  # -> simplify(Points), ParamsA, ParamsB
cluster = Cluster(data=curve_curve.Points)
tree_statistics = TreeStatistics(Tree=cluster)  # -> Paths, Length, Count

# ----
stream_filter_4 = StreamFilter(Gate=boolean_3, Stream0=simplify(graft(extend_curve)), Stream1=extend_curve)  # -> simplify(Stream)

# ---- group: Wall boundary that interferes with wall lines (continued)
tree_branch = TreeBranch(Tree=simplify(stream_filter_4), Path=tree_statistics.Paths, MaintainPaths=True)

# ---- group: Wall faces
element_geometry = ElementGeometry(Elements=wall_4, DetailLevel=1)  # -> simplify(Geometry)
level = Level(simplify(graft(wall_4)))
md_slider_3 = MDSlider(SliderMode=0, slider_value=Point(0.5, 0.5, 0.5), x_domain=Domain(0, 1), y_domain=Domain(0, 1), z_domain=Domain(0, 1))
unit_z_3 = UnitZ(Factor=1)

# ----
cluster_2 = Cluster_2(data=element_geometry)

# ---- group: Wall faces (continued)
deconstruct_brep = DeconstructBrep(Brep=cluster_2)  # -> simplify(Faces), Edges, Vertices
brep_edges = BrepEdges(Brep=deconstruct_brep.Faces)  # -> simplify(Naked), Interior, NonManifold

# ----
list_length_5 = ListLength(List=deconstruct_brep.Faces)
duplicate_data = DuplicateData(Data=level, Number=list_length_5, Order=True)  # -> simplify(graft(Data))
data = Data(flatten(deconstruct_brep.Faces))

# ---- group: Wall faces (continued)
project_3 = Project(Geometry=brep_edges.Naked, Plane=simplify(duplicate_data))  # -> simplify(Geometry), Transform
extend_curve_2 = ExtendCurve(Curve=project_3.Geometry, Type=0, Start="-10", End="-10")  # -> simplify(Curve)
collision_one_many = CollisionOneMany(Collider=simplify(extend_curve_2), Obstacles=flatten(spatial_element_boundary))  # -> Collision, Index
cull_pattern_6 = CullPattern(List=simplify(extend_curve_2), CullPattern=collision_one_many.Collision)
clean_tree_2 = CleanTree(RemoveNulls=True, RemoveInvalid=True, RemoveEmpty=True, Tree=cull_pattern_6)  # -> simplify(Tree)
tree_statistics_2 = TreeStatistics(Tree=clean_tree_2)  # -> Paths, Length, Count
tree_branch_2 = TreeBranch(Tree=simplify(graft(deconstruct_brep.Faces)), Path=tree_statistics_2.Paths, MaintainPaths=True)

# ----
tree_branch_3 = TreeBranch(Tree=simplify(deconstruct_brep.Faces), Path=tree_statistics_2.Paths, MaintainPaths=True)  # disabled

# ---- group: Wall faces (continued)
brep_7 = Brep(flatten([tree_branch_2, tree_branch_3]))
evaluate_surface = EvaluateSurface(Surface=brep_7, Point=md_slider_3)  # -> Point, Normal, UDirection, VDirection, Frame
dot_product = DotProduct(VectorA=evaluate_surface.Normal, VectorB=unit_z_3, Unitize=False)
boolean_4 = Boolean(dot_product)
cull_pattern_7 = CullPattern(List=brep_7, CullPattern=invert(boolean_4))  # -> flatten(List)

# ---- group: Cull duplicates
md_slider_4 = MDSlider(SliderMode=0, slider_value=Point(0.5, 0.5, 0.5), x_domain=Domain(0, 1), y_domain=Domain(0, 1), z_domain=Domain(0, 1))
evaluate_surface_2 = EvaluateSurface(Surface=reparameterize(cull_pattern_7), Point=md_slider_4)  # -> Point, Normal, UDirection, VDirection, Frame
create_set = CreateSet(List=evaluate_surface_2.Point)  # -> Set, Map
create_tree_2 = CreateTree(Data=cull_pattern_7, Path=create_set.Map)
list_item_3 = ListItem(List=create_tree_2, Index=0, Wrap=True)
surface = Surface(simplify(graft(list_item_3)))

# ----
surface_2 = Surface(surface)
room_8 = Room(simplify(graft(stream_filter_2)))
md_slider_5 = MDSlider(
    SliderMode=0,
    slider_value=Point(0.5, 0.57048779, 0.5),
    x_domain=Domain(0, 1),
    y_domain=Domain(0, 1),
    z_domain=Domain(0, 1))
brep_8 = Brep(room_8)
evaluate_surface_3 = EvaluateSurface(Surface=reparameterize(surface_2), Point=md_slider_5)  # -> Point, Normal, UDirection, VDirection, Frame
vector_2 = Vector(evaluate_surface_3.Normal)

number_slider = Slider(50, range=0..100)
vector_3 = Vector(evaluate_surface_3.Normal)
multiplication_2 = Multiplication(A=vector_3, B=number_slider)
# Försök att få det snabbare-lite knepigt....
extrude_2 = Extrude(Base=surface_2, Direction=multiplication_2)

solid_intersection_2 = SolidIntersection(BrepsA=flatten(extrude_2), BrepsB=simplify(graft(brep_8)))

deconstruct_brep_2 = DeconstructBrep(Brep=solid_intersection_2)  # -> Faces, Edges, Vertices
area = Area(Geometry=solid_intersection_2)  # -> Area, Centroid

evaluate_surface_4 = EvaluateSurface(Surface=reparameterize(deconstruct_brep_2.Faces), Point=md_slider)  # -> Point, Normal, UDirection, VDirection, Frame
dot_product_2 = DotProduct(VectorA=evaluate_surface_4.Normal, VectorB=unit_z, Unitize=False)
brep_9 = Brep(brep_8)
boolean_5 = Boolean(dot_product_2)
volume = Volume(Geometry=brep_9)  # -> Volume, Centroid
cull_pattern_8 = CullPattern(List=deconstruct_brep_2.Faces, CullPattern=invert(boolean_5))
area_2 = Area(Geometry=cull_pattern_8)  # -> Area, Centroid
scale = Scale(Geometry=brep_9, Center=volume.Centroid, Factor=Slider(1, range=0..1))  # -> Geometry, Transform
surface_3 = Surface(cull_pattern_8)
point_in_brep = PointInBrep(Brep=simplify(graft(scale.Geometry)), Point=flatten(area_2.Centroid), Strict=True)
cull_pattern_9 = CullPattern(List=flatten(cull_pattern_8), CullPattern=simplify(point_in_brep))
curve_2 = Curve(surface_3)
area_3 = Area(Geometry=cull_pattern_9)  # -> Area, Centroid
smaller_than = SmallerThan(FirstNumber=area_3.Area, SecondNumber=power_of_10)  # -> SmallerThan, OrEqualTo
cull_pattern_10 = CullPattern(List=cull_pattern_9, CullPattern=invert(smaller_than.SmallerThan))
evaluate_surface_5 = EvaluateSurface(Surface=reparameterize(cull_pattern_10), Point=md_slider)  # -> Point, unitize(Normal), UDirection, VDirection, Frame
multiplication_3 = Multiplication(A=evaluate_surface_5.Normal, B=number_slider)
negative = Negative(Value=multiplication_3)
move = Move(Geometry=cull_pattern_10, Motion=negative)  # -> Geometry, Transform
evaluate_surface_6 = EvaluateSurface(Surface=reparameterize(move.Geometry), Point=md_slider)  # -> Point, unitize(Normal), UDirection, VDirection, Frame
area_4 = Area(Geometry=move.Geometry)  # -> Area, Centroid
plane_3 = Plane(room_8)
spatial_element_boundary_2 = SpatialElementBoundary(SpatialElement=room_8, BoundaryLocation=0)  # -> simplify(Boundary)
project_4 = Project(Geometry=area_4.Centroid, Plane=plane_3)  # -> Geometry, Transform
point_in_curve = PointInCurve(Point=project_4.Geometry, Curve=spatial_element_boundary_2)  # -> Relationship, Point
replace_text = ReplaceText(Text=point_in_curve.Relationship, Find="2", Replace="0", RecursiveReplace=False)
cull_pattern_11 = CullPattern(List=move.Geometry, CullPattern=replace_text)
evaluate_surface_7 = EvaluateSurface(Surface=cull_pattern_11, Point=md_slider_2)  # -> Point, Normal, UDirection, VDirection, Frame
multiplication_4 = Multiplication(A=evaluate_surface_7.Normal, B=Slider(0, range=0..1000))
plane_4 = Plane(cull_pattern_11)
extrude_3 = Extrude(Base=cull_pattern_11, Direction=multiplication_4)
bounding_rectangle_2 = BoundingRectangle(Geometry=cull_pattern_11, Plane=plane_4, Axis=0, Slide=0, Union=True)  # -> simplify(Bounding), DimensionX, DimensionY
curve_3 = Curve(cull_pattern_11)
flip_curve = FlipCurve(Curve=simplify(graft(curve_3)), Guide=bounding_rectangle_2.Bounding)  # -> flatten(Curve), Flag
boundary_surfaces_2 = BoundarySurfaces(Edges=flip_curve.Curve)
add_wall_profile = AddWallProfile(Profile=simplify(graft(boundary_surfaces_2)), Type=host_type_compound_structure.Type, LocationLine=wall_location_line)  # -> simplify(Wall)
element_parameter = ElementParameter(Element=add_wall_profile, Parameter=built_in_parameters, Value=Toggle(False))  # -> Element, Value
select_element = SelectElement(Element=add_wall_profile, Selected=Toggle(True))  # -> Element, Selected
boolean_6 = Boolean(invert(select_element.Selected))
select_element_2 = SelectElement(Element=active_selection, Selected=boolean_6)  # -> Element, Selected
panel_4 = Panel(flip_curve.Flag)
panel_5 = Panel(area_3.Area)
cluster_3 = Cluster_2(data=surface_3)

element_parameter_2 = ElementParameter(Element=room_6, Parameter="Name")  # -> Element, Value
element_parameter_3 = ElementParameter(Element=room_6, Parameter="Number")  # -> Element, Value
element_parameter_4 = ElementParameter(Element=room_6, Parameter="Wall Finish")  # -> Element, Value
concatenate = Concatenate(FragmentA=element_parameter_3.Value, FragmentB=element_parameter_2.Value, JoinSeparator=":")

replace_nulls = ReplaceNulls(Items=element_parameter_4.Value, Replacements="Not specified")  # -> Items, Count

concatenate_2 = Concatenate(FragmentA="Wall Finish", FragmentB=replace_nulls.Items, JoinSeparator="::")

replace_text_2 = ReplaceText(Text=concatenate_2, RecursiveReplace=False)
panel_6 = Panel(concatenate_2)

model_object = ModelObject(Geometry=cluster_3, Name=concatenate, Layer=replace_text_2)  # -> Object, Geometry, Name, Layer, Visibility, Display, Drafting, Render
content_cache = ContentCache(Content=model_object.Object, Action=Toggle(True))  # disabled

# ==== cluster Cluster
data = ClusterInput()

# ---- group: Tree to main index
data_2 = Data(data)
clean = CleanTree(RemoveNulls=True, RemoveInvalid=False, RemoveEmpty=False, Tree=data_2)
data_3 = Data(clean)

# ---- group: Tree to main index / Gets main index from path
tstat = TreeStatistics(Tree=clean)  # -> Paths, Length, Count
split = TextSplit(Text=tstat.Paths, Separators=";")  # -> simplify(Result)
item = ListItem(List=split, Index=0, Wrap=True)
concat = Concatenate(FragmentA=item, FragmentB="}")
rep = ReplaceText(Text=concat, Find="}}", Replace="}", RecursiveReplace=False)
dup = DuplicateData(Data=rep, Number=simplify(graft(tstat.Length)), Order=True)  # -> flatten(Data)

# ---- group: Tree to main index (continued)
tree = CreateTree(Data=data_3, Path=dup)
data_4 = Data(tree)

# ----
data_5 = ClusterOutput(data_4)

# ==== cluster Cluster_2
data = ClusterInput()

# ---- group: Tree to main index
data_2 = Data(data)
clean = CleanTree(RemoveNulls=True, RemoveInvalid=True, RemoveEmpty=True, Tree=data_2)
data_3 = Data(clean)

# ---- group: Tree to main index / Gets main index from path
tstat = TreeStatistics(Tree=clean)  # -> Paths, Length, Count
split = TextSplit(Text=tstat.Paths, Separators=";")  # -> simplify(Result)
item = ListItem(List=split, Index=0, Wrap=True)
concat = Concatenate(FragmentA=item, FragmentB="}")
rep = ReplaceText(Text=concat, Find="}}", Replace="}", RecursiveReplace=False)
dup = DuplicateData(Data=rep, Number=simplify(graft(tstat.Length)), Order=True)  # -> flatten(Data)

# ---- group: Tree to main index (continued)
tree = CreateTree(Data=data_3, Path=dup)
data_4 = Data(tree)

# ----
data_5 = ClusterOutput(data_4)
