# Grasshopper definition 30_VP_Tag All.gh (Grasshopper 1.0.8)
# plug-ins: Pufferfish, Rhino.Inside for Autodesk Revit, MetaHopper

doubleclick = BooleanToggle(False)
dss_annotation_panel = Panel("Help on WhiteWork")
# Segment
# group modules into larger coherent parts
# User Interface: I/O
dss_log_v5_2 = PythonScript(Help=doubleclick)  # inputs Help: Boolean
# ---------- dss_log_v5_2: Python ----------
"""
Set grasshopper template and provide easy acces to Help file in intranet

"""

"""
Credits:
    20211117
    Created by Vladimir Ondejcik
    White arkitekter AB

Based on:
    WOMBAT version <0.0.1>
    Script by <Brian Ringley>
        def libraries() by <Giulio Piacentino> see <http://www.grasshopper3d.com/forum/topics/gh-filename-is-python>
        def writeToFile() by <Data Analytics Society> see <https://www.youtube.com/watch?v=-TF3mXhnCDw>
    Script version <15 September 2015> 
    Copyright <Creative Commons Sharealike>
"""


#add dsearch default path located on cad.local
import sys
new_path = r"\\sesthfs02\DSEARCH\REPOSITORY\Grasshopper\Xtras\DsearchCode"
if new_path not in sys.path: sys.path.append(new_path)

#import dsearch plugin
import dsearch as ds

import os

print sys.path

#reload module (this has use when working on module)
#reload(ds.DS_Log)
#reload(ds.DS_Links)

#setup template
template=ds.DS_Links.Template
ds.DS_Log.DS_Template(template)

#run help from module 
if Help:
    helpLink=ds.DS_Links.HelpLink
    ds.DS_Log.DS_Help(helpLink)

    #turn toggle back to false
    obj=ghenv.Component.Params.Input[0].Sources[0]
    obj.Value=False
    obj.ExpireSolution(True)
# ---------- end dss_log_v5_2 ----------

dss_projectnumber = Panel("0000")
dss_projectname = Panel("name")

# ----
# Organization of Grasshopper scripts at White:
# Script should be created and annotated always with notion that other person will need to use/edit them.
# Build your script in modules and segments, use color coding and annotation according this template.
# This standard should be applied to all scripts, big or small.
# 
# Read  guide on white work:
# "https://work.white.se/grasshopper-developer-guide/"
# For Advanced users:
# For design scripts running more than a month use "dsInitialize" and "dsScriptLog" functions on Dsearch tab to log changes over time.
dss_annotation_panel_2 = Panel("""Tip of a day:
You can change default colour grups by right clicking
Graphical templates are located on "Dsearch" tab""")
# GRAPHIC
# STANDARD
# In
# data and geometry import from rhino or external platforms
image = ImageSampler(dss_annotation_panel_2, Filter="Colour", Interpolate=False, Umax=1, Umin=0, Vmax=1, Vmin=0, Wrap=0)

categories_to_create_annotation_objects = Panel("""Plumbing Fixtures
Casework
Furniture
Electrical Equipment""")  # "Categories to create annotation objects to"

# ---- group: Offset from view frame
number_slider = Slider(800, range=0..1000)

# ----
button = Button()
onoff = EnableDisableObject(Enabled=Toggle(True), AllObjects_Object=multi_category_tag)

text = Text(categories_to_create_annotation_objects)
active_selection = GraphicalElement()

# ----
# Choose Section Viewport
active_view = ActiveView()
# Byggd för en viewport i taget
# -Kan byggas ut föra ta flera viewports - t.ex för ett rum
query_viewports = QueryViewports(Sheet=active_view)
view = View(query_viewports)
element_type = ElementType(Element=view)  # -> Element, Type
cset = CreateSet(List=element_type.Type)  # -> Set, Map
value_picker = ValuePicker(cset.Set)
mindex = MemberIndex(Set=element_type.Type, Member=value_picker)  # -> Index, Count
item = ListItem(List=element_type.Element, Index=mindex.Index, Wrap=True)
value_picker_2 = ValuePicker(item)
view_2 = View(active_selection)
passport = ElementPassport(Element=view_2)  # -> DocumentGUID, Document, UniqueID, Id

# ----
# General
# Monitor
# Out
# Control
# variable parameters and script execution
# (sliders, boolean togggle, text input,...)
# monitor data and geometry preview (used for panels for example)
# output data to rhino or external platforms
# WIP
# Annotation
# Plugin
# general annotation and notes
# textbased scripting and special plugins
# f.ex: HumanUI, kangaroo,...
# problematic or under repair or construction
# Back-end
dss_annotation_panel_3 = Panel("general development modules")

dss_annotation_panel_4 = Panel(view_2)

query_categories = QueryCategories(Type=1, Name="Rooms", IsVisibleUI=True, IsSubcategory=False)  # -> simplify(Categories)
query_view_elements = QueryViewElements(View=view_2, Categories=query_categories)  # -> flatten(Elements)

text_2 = Text(text)

# ---- group: Categories to be affected
txt = Text(flatten(["Plumbing Fixtures", "Casework"]))
query_categories_2 = QueryCategories(Type=1, Name=text_2, IsVisibleUI=True, IsSubcategory=False)  # -> simplify(Categories)

# ----
bounding_box = BoundingBox(Content=query_view_elements, Plane=PlaneXY(0, 0, 0))  # -> flatten(Box), Box_2
query_categories_3 = QueryCategories(Type=1, Name="Floors", IsVisibleUI=True, IsSubcategory=False)  # -> simplify(Categories)
bounding_box_filter = BoundingBoxFilter(BoundingBox=bounding_box.Box, Union=True, Strict=False, Tolerance=0, Inverted=False)  # -> Filter, Target
query_view_elements_2 = QueryViewElements(View=view_2, Categories=flatten(query_categories_2), Filter=bounding_box_filter.Filter)  # -> simplify(Elements)
query_view_elements_3 = QueryViewElements(View=simplify(graft(view_2)), Categories=query_categories_3)  # -> simplify(Elements)
graphical_element = GraphicalElement(simplify(query_view_elements_2))

# ---- group: PLACE TAGS
view_3 = View(simplify(graft(view_2)))
graphical_element_2 = GraphicalElement(simplify(graft(query_view_elements_2)))

# ---- group: PLACE TAGS / Check if tag is placed / Tag types
query_categories_4 = QueryCategories(Discipline=1, Type=2, IsVisibleUI=True, IsSubcategory=False)
tmatch = MatchText(Text=query_categories_4, RegEx="Tags", Case=True)
cull = CullPattern(List=query_categories_4, CullPattern=tmatch)

# ---- group: PLACE TAGS / Check if tag is placed
view_4 = View(view_3)
data = Data(graphical_element_2)
passport_2 = ElementPassport(Element=data)  # -> DocumentGUID, Document, UniqueID, Id
null = NullPlaceholder()

# ---- group: PLACE TAGS / Check if tag is placed / Tags in views
query_types = QueryTypes(Kind=3, Category=cull)
typefltr = TypeFilter(Types=flatten(query_types), Inverted=False)
query_view_elements_4 = QueryViewElements(View=simplify(graft(view_4)), Categories=query_categories_4, Filter=typefltr)  # -> simplify(Elements)

# ---- group: PLACE TAGS / Check if tag is placed (continued)
annotation_references = AnnotationReferences(Annotation=query_view_elements_4)  # -> simplify(References)
passport_3 = ElementPassport(Element=annotation_references)  # -> DocumentGUID, Document, UniqueID, Id
replace = ReplaceMembers(Set=passport_2.Id, Find=passport_3.Id, Replace=null)  # -> simplify(Result)
data_2 = Data(replace)

# ----
member_index = MemberIndex(Set=passport_2.Id, Member=flatten(passport_3.Id))  # -> simplify(Index), Count
mass_addition = MassAddition(Input=member_index.Count)  # -> Result, PartialResults
addition = Addition(A=mass_addition.Result, B="0")
cull_pattern = CullPattern(List=passport_2.Id, CullPattern=invert(addition))

# ---- group: PLACE TAGS
rectangle = Rectangle(view_2)
view_5 = View(view_3)
data_3 = Data(cull_pattern)
number = Number(number_slider)
pln = Plane(view_5)
Z = UnitZ(Factor=1)
clean = CleanTree(RemoveNulls=True, RemoveInvalid=True, RemoveEmpty=True, Tree=data_3, SynchronousTree1=data)  # -> Tree, SynchronousTree1
brec = BoundingRectangle(Geometry=clean.SynchronousTree1, Plane=pln, Axis=0, Slide=0, Union=True)  # -> simplify(Bounding), DimensionX, DimensionY
pcen = PolygonCenter(Polyline=brec.Bounding)  # -> CenterV, CenterE, CenterA

# ---- group: PLACE TAGS / View frame
crv = Curve(rectangle)

# ---- group: PLACE TAGS (continued)
offset = OffsetCurve(Curve=crv, Distance=number, Corners=1)
explode = Explode(Curve=offset, Recursive=True)  # -> Segments, Vertices
dprod = DotProduct(VectorA=explode.Segments, VectorB=Z, Unitize=False)
bool = Boolean(dprod)
cull_2 = CullPattern(List=explode.Segments, CullPattern=bool)
crv_cp = CurveClosestPoint(Point=pcen.CenterV, Curve=cull_2)  # -> Point, Parameter, simplify(Distance)
sort = SortList(Keys=crv_cp.Distance, ValuesA=crv_cp.Point)  # -> Keys, simplify(ValuesA)
item_2 = ListItem(List=sort.ValuesA, Index=0, Wrap=True)  # -> simplify(Item)

# ---- group: PLACE TAGS / Create tag
multi_category_tag = MultiCategoryTag(View=view_3, Element=clean.SynchronousTree1, HeadLocation=item_2)  # -> simplify(flatten(Tag))

# ----
element_type_2 = ElementType(Element=multi_category_tag)  # -> Element, Type

# ---- group: PLACE TAGS / Placing leader lines as horizontal as possible
annotation_leaders = AnnotationLeaders(Annotation=simplify(graft(multi_category_tag)), Leader=Toggle(False))  # -> Annotation, Leader, simplify(ShoulderLocations), simplify(EndLocations), TextLocations
brec_2 = BoundingRectangle(Geometry=annotation_leaders.Annotation, Plane=pln, Axis=0, Slide=0, Union=False)  # -> simplify(Bounding), DimensionX, DimensionY
pcen_2 = PolygonCenter(Polyline=brec_2.Bounding)  # -> CenterV, CenterE, CenterA
pdecon = Deconstruct(Point=item_2)  # -> XComponent, YComponent, ZComponent
element_location = ElementLocation(Element=multi_category_tag)  # -> Element, Location, Hand, Facing, WorkPlane
pdecon_2 = Deconstruct(Point=pcen_2.CenterV)  # -> XComponent, YComponent, ZComponent
subtraction = Subtraction(A=pdecon.ZComponent, B=pdecon_2.ZComponent)
Z_2 = UnitZ(Factor=subtraction)
move = Move(Geometry=element_location.Location, Motion=flatten(Z_2))  # -> Geometry, Transform
element_location_2 = ElementLocation(Element=element_location.Element, Location=move.Geometry)  # -> Element, Location, Hand, Facing, WorkPlane
annotation_leaders_2 = AnnotationLeaders(Annotation=element_location_2.Element, Leader=Toggle(True))  # -> Annotation, Leader, simplify(ShoulderLocations), simplify(EndLocations), TextLocations

# ----
type_identity = TypeIdentity(Type=element_type_2.Type)  # -> Category, FamilyName, Name
pin_element = PinElement(Element=element_location_2.Element, Pinned=Toggle(False))  # -> Element, Pinned
