# Grasshopper definition 31_VP_Hide_WrongFacing.gh (Grasshopper 1.0.8)
# plug-ins: Rhino.Inside for Autodesk Revit, MetaHopper

doubleclick = BooleanToggle(False)
dss_annotation_panel = Panel("Help on WhiteWork")
# Segment
# group modules into larger coherent parts
# User Interface: I/O
dss_log_v5_2 = PythonScript(Help=doubleclick)  # inputs Help: Boolean
# ---------- dss_log_v5_2: Python ----------
"""
Set grasshopper template and provide easy acces to Help file in intranet

"""

"""
Credits:
    20211117
    Created by Vladimir Ondejcik
    White arkitekter AB

Based on:
    WOMBAT version <0.0.1>
    Script by <Brian Ringley>
        def libraries() by <Giulio Piacentino> see <http://www.grasshopper3d.com/forum/topics/gh-filename-is-python>
        def writeToFile() by <Data Analytics Society> see <https://www.youtube.com/watch?v=-TF3mXhnCDw>
    Script version <15 September 2015> 
    Copyright <Creative Commons Sharealike>
"""


#add dsearch default path located on cad.local
import sys
new_path = r"\\sesthfs02\DSEARCH\REPOSITORY\Grasshopper\Xtras\DsearchCode"
if new_path not in sys.path: sys.path.append(new_path)

#import dsearch plugin
import dsearch as ds

import os

print sys.path

#reload module (this has use when working on module)
#reload(ds.DS_Log)
#reload(ds.DS_Links)

#setup template
template=ds.DS_Links.Template
ds.DS_Log.DS_Template(template)

#run help from module 
if Help:
    helpLink=ds.DS_Links.HelpLink
    ds.DS_Log.DS_Help(helpLink)

    #turn toggle back to false
    obj=ghenv.Component.Params.Input[0].Sources[0]
    obj.Value=False
    obj.ExpireSolution(True)
# ---------- end dss_log_v5_2 ----------

dss_projectnumber = Panel("0000")
dss_projectname = Panel("name")

# ----
# Organization of Grasshopper scripts at White:
# Script should be created and annotated always with notion that other person will need to use/edit them.
# Build your script in modules and segments, use color coding and annotation according this template.
# This standard should be applied to all scripts, big or small.
# 
# Read  guide on white work:
# "https://work.white.se/grasshopper-developer-guide/"
# For Advanced users:
# For design scripts running more than a month use "dsInitialize" and "dsScriptLog" functions on Dsearch tab to log changes over time.
dss_annotation_panel_2 = Panel("""Tip of a day:
You can change default colour grups by right clicking
Graphical templates are located on "Dsearch" tab""")
# GRAPHIC
# STANDARD
# In
# data and geometry import from rhino or external platforms
image = ImageSampler(dss_annotation_panel_2, Filter="Colour", Interpolate=False, Umax=1, Umin=0, Vmax=1, Vmin=0, Wrap=0)

graphical_element = GraphicalElement(<familyinstance referenced from the Revit model>)

# ---- group: Hide stuff facing the wrong way
button = Button()
hide_true_show_false = BooleanToggle(True)
onoff = EnableDisableObject(Enabled=Toggle(True), AllObjects_Object=element_graphic_overrides)
bool = Boolean(hide_true_show_false)

# ----
categories_to_create_annotation_objects = Panel("""Plumbing Fixtures
Casework
Furniture
Electrical Equipment""")  # "Categories to create annotation objects to"

component_references = ComponentReferences(Component=graphical_element)  # -> Left, CenterLeftRight, Right, Front, CenterFrontBack, Back, Bottom, CenterElevation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
text = Text(categories_to_create_annotation_objects)
data = Data([component_references.Left, component_references.CenterLeftRight, component_references.Right, component_references.Front, component_references.CenterFrontBack, component_references.Back, component_references.Bottom, component_references.CenterElevation, component_references.Top])
active_selection = GraphicalElement()

# ----
# Choose Section Viewport
active_view = ActiveView()
# Byggd för en viewport i taget
# -Kan byggas ut föra ta flera viewports - t.ex för ett rum
query_viewports = QueryViewports(Sheet=active_view)
view = View(query_viewports)
element_type = ElementType(Element=view)  # -> Element, Type
cset = CreateSet(List=element_type.Type)  # -> Set, Map
value_picker = ValuePicker(cset.Set)
mindex = MemberIndex(Set=element_type.Type, Member=value_picker)  # -> Index, Count
item = ListItem(List=element_type.Element, Index=mindex.Index, Wrap=True)
value_picker_2 = ValuePicker(item)
view_2 = View(active_selection)
passport = ElementPassport(Element=view_2)  # -> DocumentGUID, Document, UniqueID, Id

panel = Panel(data)

# ----
# General
# Monitor
# Out
# Control
# variable parameters and script execution
# (sliders, boolean togggle, text input,...)
# monitor data and geometry preview (used for panels for example)
# output data to rhino or external platforms
# WIP
# Annotation
# Plugin
# general annotation and notes
# textbased scripting and special plugins
# f.ex: HumanUI, kangaroo,...
# problematic or under repair or construction
# Back-end
dss_annotation_panel_3 = Panel("general development modules")

text_2 = Text(text)

# ---- group: Categories to be affected
txt = Text(flatten(text_2))
panel_2 = Panel(txt)
query_categories = QueryCategories(Type=1, Name=txt, IsVisibleUI=True, IsSubcategory=False)  # -> simplify(Categories)

# ----
dss_annotation_panel_4 = Panel(view_2)
txt_2 = Text(flatten(text_2))

# ---- group: Hides stuff not having face vector close to view vector
view_3 = View(view_2)
query_view_elements = QueryViewElements(View=view_3, Categories=query_categories)  # -> simplify(Elements)
pln = Plane(view_3)
element_location = ElementLocation(Element=query_view_elements)  # -> Element, Location, Hand, Facing, WorkPlane
vec = Vector(pln)
vec_2 = Vector(element_location.Facing)
dprod = DotProduct(VectorA=vec, VectorB=vec_2, Unitize=False)
round = Round(Number=dprod)  # -> Nearest, Floor, Ceiling
txt_3 = Text(round.Nearest)
bool_2 = Boolean(txt_3)
cull = CullPattern(List=simplify(query_view_elements), CullPattern=invert(simplify(bool_2)))  # -> simplify(List)
clean = CleanTree(RemoveNulls=True, RemoveInvalid=True, RemoveEmpty=True, Tree=cull)  # -> flatten(Tree)
graphical_element_2 = GraphicalElement(simplify(graft(clean)))
bool_3 = Boolean(bool)
lng = ListLength(List=graphical_element_2)
dup = DuplicateData(Data=bool_3, Number=lng, Order=True)
element_graphic_overrides = ElementGraphicOverrides(View=simplify(graft(view_3)), Element=graphical_element_2, Hidden=simplify(graft(dup)))  # -> View, Element, Hidden, Overrides

# ---- group: Unhides things
query_categories_2 = QueryCategories(Type=1, Name="Rooms", IsVisibleUI=True, IsSubcategory=False)  # -> simplify(Categories)
category_filter = CategoryFilter(Categories=flatten(query_categories), Inverted=False)
list_length = ListLength(List=clean)
addition = Addition(A=list_length, B="0")
boolean = Boolean(addition)
stream_filter = StreamFilter(Gate=boolean, Stream0=view_3)

# ----
stream_filter_2 = StreamFilter(Gate=boolean, Stream0=view_3)

# ---- group: Unhides things (continued)
query_view_elements_2 = QueryViewElements(View=stream_filter_2, Categories=flatten(query_categories_2))
bounding_box = BoundingBox(Content=query_view_elements_2, Plane=PlaneXY(0, 0, 0), UnionBox=True)  # -> Box, Box_2
bounding_box_filter = BoundingBoxFilter(BoundingBox=bounding_box.Box, Union=True, Strict=False, Tolerance=0, Inverted=False)  # -> Filter, Target
logical_and_filter = LogicalAndFilter(FilterA=bounding_box_filter.Filter, FilterB=category_filter)
query_elements = QueryElements(Filter=logical_and_filter)  # -> Elements, Count
element_graphic_overrides_2 = ElementGraphicOverrides(View=simplify(graft(view_3)), Element=query_elements.Elements)  # -> View, Element, Hidden, Overrides
null_item = NullItem(Item=element_graphic_overrides_2.Hidden)  # -> NullFlags, InvalidFlags, Description
cull_pattern = CullPattern(List=element_graphic_overrides_2.Element, CullPattern=invert(null_item.NullFlags))
cull_pattern_2 = CullPattern(List=element_graphic_overrides_2.Hidden, CullPattern=invert(null_item.NullFlags))
boolean_2 = Boolean(invert(cull_pattern_2))
cull_pattern_3 = CullPattern(List=cull_pattern, CullPattern=cull_pattern_2)
cull_pattern_4 = CullPattern(List=boolean_2, CullPattern=cull_pattern_2)
element_graphic_overrides_3 = ElementGraphicOverrides(View=simplify(graft(stream_filter)), Element=cull_pattern_3, Hidden=simplify(cull_pattern_4))  # -> View, Element, Hidden, Overrides
