# Grasshopper definition 32_VP_Dim All.gh (Grasshopper 1.0.8)
# plug-ins: CORE.Toolbox.Grasshopper, treesloth01, Pufferfish, Rhino.Inside for Autodesk Revit, eleFront

doubleclick = BooleanToggle(False)
dss_annotation_panel = Panel("Help on WhiteWork")
# Segment
# group modules into larger coherent parts
# User Interface: I/O
dss_log_v5_2 = PythonScript(Help=doubleclick)  # inputs Help: Boolean
# ---------- dss_log_v5_2: Python ----------
"""
Set grasshopper template and provide easy acces to Help file in intranet

"""

"""
Credits:
    20211117
    Created by Vladimir Ondejcik
    White arkitekter AB

Based on:
    WOMBAT version <0.0.1>
    Script by <Brian Ringley>
        def libraries() by <Giulio Piacentino> see <http://www.grasshopper3d.com/forum/topics/gh-filename-is-python>
        def writeToFile() by <Data Analytics Society> see <https://www.youtube.com/watch?v=-TF3mXhnCDw>
    Script version <15 September 2015> 
    Copyright <Creative Commons Sharealike>
"""


#add dsearch default path located on cad.local
import sys
new_path = r"\\sesthfs02\DSEARCH\REPOSITORY\Grasshopper\Xtras\DsearchCode"
if new_path not in sys.path: sys.path.append(new_path)

#import dsearch plugin
import dsearch as ds

import os

print sys.path

#reload module (this has use when working on module)
#reload(ds.DS_Log)
#reload(ds.DS_Links)

#setup template
template=ds.DS_Links.Template
ds.DS_Log.DS_Template(template)

#run help from module 
if Help:
    helpLink=ds.DS_Links.HelpLink
    ds.DS_Log.DS_Help(helpLink)

    #turn toggle back to false
    obj=ghenv.Component.Params.Input[0].Sources[0]
    obj.Value=False
    obj.ExpireSolution(True)
# ---------- end dss_log_v5_2 ----------

dss_projectnumber = Panel("0000")
dss_projectname = Panel("name")

# ----
# Organization of Grasshopper scripts at White:
# Script should be created and annotated always with notion that other person will need to use/edit them.
# Build your script in modules and segments, use color coding and annotation according this template.
# This standard should be applied to all scripts, big or small.
# 
# Read  guide on white work:
# "https://work.white.se/grasshopper-developer-guide/"
# For Advanced users:
# For design scripts running more than a month use "dsInitialize" and "dsScriptLog" functions on Dsearch tab to log changes over time.
dss_annotation_panel_2 = Panel("""Tip of a day:
You can change default colour grups by right clicking
Graphical templates are located on "Dsearch" tab""")
# GRAPHIC
# STANDARD
# In
# data and geometry import from rhino or external platforms
image = ImageSampler(dss_annotation_panel_2, Filter="Colour", Interpolate=False, Umax=1, Umin=0, Vmax=1, Vmin=0, Wrap=0)

categories_to_create_annotation_objects = Panel("""Plumbing Fixtures
Casework
Furniture
Electrical Equipment""")  # "Categories to create annotation objects to"

# ---- group: Offset from view frame
number_slider = Slider(300, range=0..1000)

# ----
text = Text(categories_to_create_annotation_objects)
active_selection = GraphicalElement()

# ----
# Choose Section Viewport
active_view = ActiveView()
query_viewports = QueryViewports(Sheet=active_view)
view = View(query_viewports)
element_type = ElementType(Element=view)  # -> Element, Type
cset = CreateSet(List=element_type.Type)  # -> Set, Map
value_picker = ValuePicker(cset.Set)
mindex = MemberIndex(Set=element_type.Type, Member=value_picker)  # -> Index, Count
item = ListItem(List=element_type.Element, Index=mindex.Index, Wrap=True)
value_picker_2 = ValuePicker(item)
view_2 = View(active_selection)
passport = ElementPassport(Element=view_2)  # -> DocumentGUID, Document, UniqueID, Id

# ----
# General
# Monitor
# Out
# Control
# variable parameters and script execution
# (sliders, boolean togggle, text input,...)
# monitor data and geometry preview (used for panels for example)
# output data to rhino or external platforms
# WIP
# Annotation
# Plugin
# general annotation and notes
# textbased scripting and special plugins
# f.ex: HumanUI, kangaroo,...
# problematic or under repair or construction
# Back-end
dss_annotation_panel_3 = Panel("general development modules")

dss_annotation_panel_4 = Panel(view_2)

query_categories = QueryCategories(Type=1, Name="Rooms", IsVisibleUI=True, IsSubcategory=False)  # -> simplify(Categories)
query_view_elements = QueryViewElements(View=view_2, Categories=query_categories)  # -> flatten(Elements)

number_slider_2 = Slider(50, range=0..100)
rectangle = Rectangle(view_2)
offset_curve = OffsetCurve(Curve=rectangle, Distance=number_slider_2, Corners=1)
box_rectangle = BoxRectangle(Rectangle=offset_curve, Height=number_slider_2)
bounding_box_filter = BoundingBoxFilter(BoundingBox=simplify(box_rectangle), Union=True, Strict=False, Tolerance=0, Inverted=False)  # -> Filter, Target

query_categories_2 = QueryCategories(Type=1, Name="Walls", IsVisibleUI=True, IsSubcategory=False)  # -> simplify(Categories)
query_view_elements_2 = QueryViewElements(View=simplify(graft(view_2)), Categories=query_categories_2, Filter=bounding_box_filter.Filter)  # -> simplify(Elements)

tree_branch = TreeBranch(Tree=query_view_elements_2, Path=Slider(1, range=0..100), MaintainPaths=True)
view_3 = View(simplify(graft(view_2)))
plane = Plane(view_3)
rectangle_2 = Rectangle(view_3)
deconstruct_plane = DeconstructPlane(Plane=plane)  # -> Origin, XAxis, YAxis, ZAxis
plane_2 = Plane()
plane_3 = Plane()
vector_display = VectorDisplay(Anchor=deconstruct_plane.Origin, Vector=deconstruct_plane.ZAxis)
plane_4 = Plane()
view_4 = View(simplify(graft(view_2)))
panel = Panel("""1
2""")
pln = Plane(view_4)
number_slider_3 = Slider(1, range=0..1)
pln_2 = Plane(view_4)

# ----
# Vertical dimension chain
view_5 = View(simplify(graft(view_2)))

# ---- group: Planes to draw dimensions to
# Left
# Center (Left/Right)
# Right
# Front
# Center (Front/Back)
# Back
# Bottom
# Center (Elevation)
# Top
panel_2 = Panel("""Left
Center (Left/Right)
Right""")
panel_3 = Panel("""Bottom
Center (Elevation)
Top""")

# ---- group: Planes to draw dimensions to / Horisontal dimension
z_dimension = ValuePicker(panel_2)

# ---- group: Planes to draw dimensions to / Vertical dimension
z_dimension_2 = ValuePicker(panel_3)

# ---- group: Planes to draw dimensions to (continued)
panel_4 = Panel(z_dimension_2)
panel_5 = Panel(z_dimension)

# ---- group: Categories to be affected
# Basic geometry for the view
txt = Text(flatten(["Plumbing Fixtures", "Casework"]))

# ----
text_2 = Text(text)
query_categories_3 = QueryCategories(Type=1, Name="Floors", IsVisibleUI=True, IsSubcategory=False)  # -> simplify(Categories)
bounding_box = BoundingBox(Content=query_view_elements, Plane=PlaneXY(0, 0, 0))  # -> flatten(Box), Box_2
query_view_elements_3 = QueryViewElements(View=simplify(graft(view_2)), Categories=query_categories_3)  # -> simplify(Elements)
bounding_box_filter_2 = BoundingBoxFilter(BoundingBox=bounding_box.Box, Union=True, Strict=False, Tolerance=0, Inverted=False)  # -> Filter, Target

# ---- group: Categories to be affected (continued)
query_categories_4 = QueryCategories(Type=1, Name=text_2, IsVisibleUI=True, IsSubcategory=False)  # -> simplify(Categories)

# ----
query_view_elements_4 = QueryViewElements(View=view_2, Categories=flatten(query_categories_4), Filter=bounding_box_filter_2.Filter)  # -> simplify(Elements)
graphical_element = GraphicalElement(simplify(query_view_elements_4))

# ---- group: Top face of floor
item_2 = ListItem(List=query_view_elements_3, Index=0, Wrap=True)
element_references = ElementReferences(Element=item_2)  # -> Faces, Edges, Lines
md_slider = MDSlider(SliderMode=0, slider_value=Point(0.5, 0.5, 0.5), x_domain=Domain(0, 1), y_domain=Domain(0, 1), z_domain=Domain(0, 1))
srf = Surface(element_references.Faces)
evalsrf = EvaluateSurface(Surface=srf, Point=md_slider)  # -> Point, Normal, UDirection, VDirection, Frame
Z = UnitZ(Factor=1)
dprod = DotProduct(VectorA=evalsrf.Normal, VectorB=Z, Unitize=False)
equals = Equality(FirstNumber=dprod, SecondNumber="1")  # -> Equality, Inequality
cull = CullPattern(List=element_references.Faces, CullPattern=equals.Equality)  # -> simplify(List)

# ---- group: Bounding regtangle of viewport
view_6 = View(simplify(graft(view_2)))
pln_3 = Plane(view_6)
brec = BoundingRectangle(Geometry=graphical_element, Plane=pln_3, Axis=0, Slide=0, Union=True)  # -> Bounding, DimensionX, DimensionY
pcen = PolygonCenter(Polyline=brec.Bounding)  # -> CenterV, CenterE, CenterA
pt = Point(pcen.CenterV)

# ---- group: Reference planes
text_3 = Text(panel_5)
component_reference_plane = ComponentReferencePlane(Component=graphical_element, Name=text_3)

# ---- group: Adjust so it compares right direction
data = Data(component_reference_plane)
null = NullItem(Item=data)  # -> NullFlags, InvalidFlags, Description
cull_2 = CullPattern(List=data, CullPattern=invert(null.NullFlags))
clean = CleanTree(RemoveNulls=True, RemoveInvalid=True, RemoveEmpty=True, Tree=cull_2)

# ---- group: Adjust so it compares right direction / Removes ref planes facing the wrong way
view_7 = View(simplify(graft(view_2)))
face = Face(clean)
plane_5 = Plane(face)
plane_6 = Plane(view_7)
deconstruct_plane_2 = DeconstructPlane(Plane=plane_5)  # -> Origin, XAxis, YAxis, ZAxis
deconstruct_plane_3 = DeconstructPlane(Plane=plane_6)  # -> Origin, XAxis, YAxis, ZAxis
dot_product = DotProduct(VectorA=deconstruct_plane_2.ZAxis, VectorB=deconstruct_plane_3.ZAxis, Unitize=False)
round = Round(Number=dot_product)  # -> Nearest, Floor, Ceiling
boolean = Boolean(round.Nearest)

# ---- group: Reference planes
graphical_element_2 = GraphicalElement(graphical_element)
text_4 = Text(panel_4)
component_reference_plane_2 = ComponentReferencePlane(Component=graphical_element_2, Name=text_4)
data_2 = Data(component_reference_plane_2)
null_2 = NullItem(Item=data_2)  # -> NullFlags, InvalidFlags, Description
cull_3 = CullPattern(List=data_2, CullPattern=invert(null_2.NullFlags))
clean_2 = CleanTree(RemoveNulls=True, RemoveInvalid=True, RemoveEmpty=True, Tree=cull_3)
data_3 = Data(clean_2)

# ----
cull_pattern = CullPattern(List=face, CullPattern=invert(boolean))

# ---- group: Top face of floor
data_4 = Data(simplify(cull))

# ---- group: Horizontal dimensions
pt_2 = Point(pcen.CenterV)

# ---- group: Vertical dimensions
rectangle_3 = Rectangle(simplify(view_6))
Z_2 = UnitZ(Factor=1)

# ---- group: Vertical dimensions / View frame
crv = Curve(rectangle_3)

# ---- group: Vertical dimensions (continued)
offset = OffsetCurve(Curve=crv, Distance=number_slider, Corners=1)  # -> simplify(Curve)
explode = Explode(Curve=offset, Recursive=True)  # -> Segments, Vertices
dprod_2 = DotProduct(VectorA=explode.Segments, VectorB=Z_2, Unitize=False)
bool = Boolean(dprod_2)
cull_4 = CullPattern(List=explode.Segments, CullPattern=bool)
crv_cp = CurveClosestPoint(Point=pt, Curve=cull_4)  # -> Point, Parameter, Distance
sort = SortList(Keys=crv_cp.Distance, ValuesA=cull_4)  # -> Keys, simplify(ValuesA)

# ---- group: Horizontal dimensions (continued)
cull_5 = CullPattern(List=explode.Segments, CullPattern=invert(bool))
crv_cp_2 = CurveClosestPoint(Point=pt_2, Curve=cull_5)  # -> Point, Parameter, Distance
sort_2 = SortList(Keys=crv_cp_2.Distance, ValuesA=cull_5)  # -> Keys, ValuesA
item_3 = ListItem(List=sort_2.ValuesA, Index=0, Wrap=True)  # -> simplify(Item)

# ---- group: Find Wall face
element_references_2 = ElementReferences(Element=query_view_elements_2)  # -> simplify(Faces), Edges, Lines
md_slider_2 = MDSlider(SliderMode=0, slider_value=Point(0.5, 0.5, 0.5), x_domain=Domain(0, 1), y_domain=Domain(0, 1), z_domain=Domain(0, 1))
srf_2 = Surface(element_references_2.Faces)
Z_3 = UnitZ(Factor=1)
evalsrf_2 = EvaluateSurface(Surface=srf_2, Point=md_slider_2)  # -> Point, Normal, UDirection, VDirection, Frame
dprod_3 = DotProduct(VectorA=evalsrf_2.Normal, VectorB=unitize(item_3), Unitize=False)
equals_2 = Equality(FirstNumber=dprod_3, SecondNumber="1")  # -> Equality, Inequality
cull_6 = CullPattern(List=element_references_2.Faces, CullPattern=dprod_3)  # -> simplify(List)
project = Project(Geometry=simplify(pt_2), Plane=cull_6)  # -> simplify(Geometry), simplify(Transform)
cluster = Cluster(data=project.Geometry)
cluster_2 = Cluster(data=cull_6)
ln = Line(StartPoint=simplify(pt_2), EndPoint=cluster)  # -> simplify(Line)
cluster_3 = Cluster(data=ln)
len = Length(Curve=cluster_3)
sort_3 = SortList(Keys=len, ValuesA=cluster_2)  # -> Keys, ValuesA
item_4 = ListItem(List=sort_3.ValuesA, Index=0, Wrap=True)

# ----
plane_7 = Plane(element_references_2.Faces)
deconstruct_plane_4 = DeconstructPlane(Plane=plane_7)  # -> Origin, XAxis, YAxis, ZAxis
cluster_4 = Cluster(data=deconstruct_plane_4.ZAxis)
cluster_5 = Cluster(data=element_references_2.Faces)
vector = Vector(item_3)
dot_product_2 = DotProduct(VectorA=vector, VectorB=cluster_4, Unitize=True)
vector_display_2 = VectorDisplay(Anchor=deconstruct_plane_4.Origin, Vector=deconstruct_plane_4.ZAxis)
round_2 = Round(Number=dot_product_2)  # -> Nearest, Floor, Ceiling
cull_pattern_2 = CullPattern(List=cluster_5, CullPattern=round_2.Nearest)
line_plane = LinePlane(Line=item_3, Plane=cull_pattern_2)  # -> Point, ParamL, ParamP
sort_list = SortList(Keys=line_plane.ParamL, ValuesValuesA=cull_pattern_2)  # -> Keys, ValuesValuesA
list_item = ListItem(List=sort_list.ValuesValuesA, Index=panel, Wrap=True)
list_item_2 = ListItem(List=list_item, Index=0, Wrap=True)

# ---- group: Ugly way of finding closest point
view_8 = View(simplify(graft(view_2)))
element_location = ElementLocation(Element=data_3)  # -> Element, Location, Hand, Facing, WorkPlane
plane_8 = Plane(view_8)
curve = Curve(reparameterize(sort.ValuesA))
number_slider_4 = Slider(1, range=0..1)
project_2 = Project(Geometry=element_location.Location, Plane=plane_8)  # -> Geometry, Transform
project_3 = Project(Geometry=element_location.Location, Plane=plane_8)  # -> Geometry, Transform
list_item_3 = ListItem(List=curve, Index="0", Wrap=True)
list_item_4 = ListItem(List=curve, Index="1", Wrap=True)
curve_closest_point = CurveClosestPoint(Point=simplify(project_2.Geometry), Curve=simplify(list_item_3))  # -> simplify(Point), Parameter, simplify(Distance)
curve_closest_point_2 = CurveClosestPoint(Point=simplify(project_3.Geometry), Curve=simplify(list_item_4))  # -> simplify(Point), Parameter, simplify(Distance)
number = Number(simplify(graft(curve_closest_point.Distance)))
list_length = ListLength(List=number)
list_length_2 = ListLength(List=number)
number_2 = Number(simplify(graft(curve_closest_point_2.Distance)))
duplicate_data = DuplicateData(Data="0", Number=list_length, Order=True)
merge = Merge(Data1=number, Data2=number_2)  # -> simplify(Result)
duplicate_data_2 = DuplicateData(Data="1", Number=list_length_2, Order=True)
merge_2 = Merge(Data1=duplicate_data, Data2=duplicate_data_2)  # -> simplify(Result)
sort_list_2 = SortList(Keys=merge, ValuesValuesA=merge_2)  # -> Keys, ValuesValuesA
list_item_5 = ListItem(List=sort_list_2.ValuesValuesA, Index=0, Wrap=True)
cluster_6 = Cluster(data=list_item_5)

# ---- group: Remove duplicate dimensions
face_2 = Face(cull_pattern)
element_location_2 = ElementLocation(Element=face_2)  # -> Element, Location, Hand, Facing, WorkPlane
curve_2 = Curve(item_3)

# ----
project_4 = Project(Geometry=element_location_2.Location, Plane=pln)  # -> Geometry, Transform

# ---- group: Remove duplicate dimensions (continued)
point = Point(project_4.Geometry)
curve_closest_point_3 = CurveClosestPoint(Point=simplify(point), Curve=reparameterize(curve_2))  # -> simplify(Point), simplify(Parameter), simplify(Distance)
cull_duplicates = CullDuplicates(Points=curve_closest_point_3.Point, Tolerance=0.1, CullMode=3)  # -> Points, simplify(Indices), Valence
list_item_6 = ListItem(List=cull_pattern, Index=cull_duplicates.Indices, Wrap=True)  # -> simplify(Item)

# ----
# Horizontal dimension chain
view_9 = View(view_2)
item_5 = ListItem(List=item_3, Index="1", Wrap=True)

list_length_3 = ListLength(List=view_9)
smaller_than = SmallerThan(FirstNumber=list_length_3, SecondNumber="1")  # -> SmallerThan, OrEqualTo
stream_filter = StreamFilter(Gate=smaller_than.OrEqualTo, Stream0=list_item, Stream1=flatten(list_item))
data_5 = Data(simplify([stream_filter, list_item_6]))
view_10 = View(simplify(graft(view_9)))
stream_filter_2 = StreamFilter(Gate=smaller_than.OrEqualTo, Stream0=data_5, Stream1=flatten(data_5))
panel_6 = Panel(view_10)
line = Line(item_5)
tree_branch_2 = TreeBranch(Tree=line, Path="0", MaintainPaths=True)
tree_branch_3 = TreeBranch(Tree=view_10, Path="0", MaintainPaths=True)
rectangle_4 = Rectangle(tree_branch_3)

# ---- group: Putting references in right order
element_location_3 = ElementLocation(Element=stream_filter_2)  # -> Element, Location, Hand, Facing, WorkPlane
curve_3 = Curve(item_3)

# ----
project_5 = Project(Geometry=element_location_3.Location, Plane=pln_2)  # -> Geometry, Transform
point_2 = Point(project_5.Geometry)

# ---- group: Putting references in right order (continued)
curve_closest_point_4 = CurveClosestPoint(Point=simplify(project_5.Geometry), Curve=reparameterize(curve_3))  # -> simplify(Point), simplify(Parameter), simplify(Distance)
sort_list_3 = SortList(Keys=simplify(curve_closest_point_4.Parameter), ValuesValuesA=simplify(stream_filter_2))  # -> Keys, simplify(ValuesValuesA)

# ----
panel_7 = Panel(sort_list_3.ValuesValuesA)

add_aligned_dimension = AddAlignedDimension(View=view_10, References=sort_list_3.ValuesValuesA, Line=line, FailureProcessingMode=1)

element_location_4 = ElementLocation(Element=sort_list_3.ValuesValuesA)  # -> Element, Location, Hand, Facing, WorkPlane
pin_element = PinElement(Element=add_aligned_dimension, Pinned=Toggle(False))  # -> Element, Pinned
tree_branch_4 = TreeBranch(Tree=sort_list_3.ValuesValuesA, Path="0", MaintainPaths=True)
add_aligned_dimension_2 = AddAlignedDimension(View=tree_branch_3, References=tree_branch_4, Line=tree_branch_2, FailureProcessingMode=1)  # disabled

tree_statistics = TreeStatistics(Tree=cluster_6)  # -> Paths, Length, Count
list_item_7 = ListItem(List=curve, Index=cluster_6, Wrap=True)  # -> simplify(graft(Item))
replace_text = ReplaceText(Text=tree_statistics.Paths, Find="}", Replace=";", RecursiveReplace=False)
concatenate = Concatenate(Fragment_A=simplify(graft(replace_text)), Fragment_B=cluster_6, A="}")
create_tree = CreateTree(Data=flatten(data_3), Path=concatenate)
create_tree_2 = CreateTree(Data=flatten(list_item_7), Path=concatenate)
list_item_8 = ListItem(List=create_tree_2, Index=0, Wrap=True)

# ---- group: Floor
renumber_paths = RenumberPaths(Data=data_4)
list_length_4 = ListLength(List=list_item_5)
duplicate_data_3 = DuplicateData(Data=renumber_paths, Number=list_length_4, Order=True)  # -> simplify(Data)
create_tree_3 = CreateTree(Data=flatten(duplicate_data_3), Path=concatenate)  # -> simplify(Data)
list_item_9 = ListItem(List=create_tree_3, Index=0, Wrap=True)

# ----
data_6 = Data([create_tree, list_item_9])
tree_statistics_2 = TreeStatistics(Tree=data_6)  # -> Paths, Length, Count

tree_statistics_3 = TreeStatistics(Tree=list_item_8)  # -> Paths, Length, Count
text_split = TextSplit(Text=tree_statistics_3.Paths, Separators=";")
replace_text_2 = ReplaceText(Text=";", Find="}", Replace="}", RecursiveReplace=False)
list_item_10 = ListItem(List=text_split, Index=0, Wrap=True)
concatenate_2 = Concatenate(FragmentA=list_item_10, FragmentB="}")
tree_branch_5 = TreeBranch(Tree=view_5, Path=concatenate_2, MaintainPaths=True)  # -> graft(Branch)

panel_8 = Panel(list_item_9)
plane_9 = Plane(tree_branch_5)

# ---- group: Seperate path for only one viewport
create_tree_4 = CreateTree(Data=duplicate_data_3, Path=list_item_5)
create_tree_5 = CreateTree(Data=data_3, Path=flatten(list_item_5))
view_11 = View(simplify(graft(view_2)))
list_length_5 = ListLength(List=flatten(view_11))
list_item_11 = ListItem(List=create_tree_4, Index=0, Wrap=True)
subtraction = Subtraction(A=list_length_5, B="1")
boolean_2 = Boolean(subtraction)

# ---- group: Putting references in right order
relay = Relay([data_6, list_item_9])
element_location_5 = ElementLocation(Element=relay)  # -> Element, Location, Hand, Facing, WorkPlane
curve_4 = Curve(list_item_8)

# ----
project_6 = Project(Geometry=element_location_5.Location, Plane=plane_9)  # -> Geometry, Transform
point_3 = Point(project_6.Geometry)
clean_duplicate_points = CleanDuplicatePoints(Points=point_3, Tolerance=0.01)  # -> Points, Indices, Status
cull_pattern_3 = CullPattern(List=element_location_5.Location, CullPattern=clean_duplicate_points.Status)  # -> simplify(List)
cull_pattern_4 = CullPattern(List=relay, CullPattern=clean_duplicate_points.Status)  # -> simplify(List)

# ---- group: Putting references in right order (continued)
curve_closest_point_5 = CurveClosestPoint(Point=simplify(cull_pattern_3), Curve=reparameterize(curve_4))  # -> simplify(Point), simplify(Parameter), simplify(Distance)
sort_list_4 = SortList(
    Keys=simplify(curve_closest_point_5.Parameter),
    ValuesValuesA=simplify(cull_pattern_4),
    ValuesA=curve_closest_point_5.Point)  # -> Keys, simplify(ValuesValuesA), ValuesA

# ----
point_4 = Point(curve_closest_point_5.Point)
panel_9 = Panel(cull_pattern_4)

stream_filter_3 = StreamFilter(Gate=boolean_2, Stream0=[create_tree_5, list_item_11], Stream1=sort_list_4.ValuesValuesA)
renumber_paths_2 = RenumberPaths(Data=stream_filter_3)
stream_filter_4 = StreamFilter(Gate=boolean_2, Stream0=curve, Stream1=list_item_8)  # -> simplify(graft(Stream))
stream_filter_5 = StreamFilter(Gate=boolean_2, Stream0=view_11, Stream1=tree_branch_5)  # -> simplify(Stream)
add_aligned_dimension_3 = AddAlignedDimension(View=stream_filter_5, References=renumber_paths_2, Line=stream_filter_4)

panel_10 = Panel(sort_list_4.ValuesValuesA)
pin_element_2 = PinElement(Element=add_aligned_dimension_3, Pinned=Toggle(False))  # -> Element, Pinned

# ==== cluster Cluster
data = ClusterInput()

# ---- group: Tree to main index
data_2 = Data(data)
clean = CleanTree(RemoveNulls=True, RemoveInvalid=True, RemoveEmpty=True, Tree=data_2)
data_3 = Data(clean)

# ---- group: Tree to main index / Gets main index from path
tstat = TreeStatistics(Tree=clean)  # -> Paths, Length, Count
split = TextSplit(Text=tstat.Paths, Separators=";")  # -> simplify(Result)
item = ListItem(List=split, Index=0, Wrap=True)
concat = Concatenate(FragmentA=item, FragmentB="}")
rep = ReplaceText(Text=concat, Find="}}", Replace="}", RecursiveReplace=False)
dup = DuplicateData(Data=rep, Number=simplify(graft(tstat.Length)), Order=True)  # -> flatten(Data)

# ---- group: Tree to main index (continued)
tree = CreateTree(Data=data_3, Path=dup)
data_4 = Data(tree)

# ----
data_5 = ClusterOutput(data_4)
